# Grasshopper definition Constant Chord Force.gh (Grasshopper 0.9.76)
# plug-ins: Python Interpreter, Topos5

# ----
# TEXT TAG POSITIONS
load_line_labels = Slider(4.5, range=0..20)
load_line_midpoint_label = Slider(5, range=0..20)
number_point_labels_distance = Slider(5, range=0..20)
total_load_path_label_distance = Slider(36, range=0..100)

# ----
# BOUNDARY CONDITIONS
number_of_panels = Slider(5, range=0..50)
applied_force_magnitude = Slider(20, range=0..50)
panel_width = Slider(30, range=0..50)

# ----
# MANIPULATE FORCE POLYGON
# Force Magnitude
list = ValueList({"Constant Top Chord": 1, "Constant Bottom Chord": 2}, selected="Constant Top Chord")
chord_force_magnitude = Slider(40, range=0..100)
click_to_create_sliders = Button()

python = PythonScript(
    y=number_of_panels,
    z=click_to_create_sliders,
    u=[Slider(0.75, range=0..1), Slider(0.75, range=0..1), Slider(0.75, range=0..1), Slider(0.75, range=0..1), Slider(0.75, range=0..1)])  # -> out, a; inputs y: Int32
# ---------- python: Python ----------
import Grasshopper as gh
import System.Drawing as sd
import rhinoscriptsyntax as rs

comp = ghenv.Component
ghdoc = comp.OnPingDocument()
canvas = gh.Instances.ActiveCanvas

#Circle = x
Panels = y
Default = 0.75

if z == True:
    for x in range(Panels):
        Slider = gh.Kernel.Special.GH_NumberSlider()
        Mag = Default
        ghdoc.AddObject(Slider,False,ghdoc.ObjectCount+1)
        targetInput = comp.Params.Input[2]
        thisPivot = targetInput.Attributes.Pivot
        Slider.Attributes.Pivot = sd.PointF(thisPivot.X-450,thisPivot.Y+(25*(x+1)))
        targetInput.AddSource(Slider)
        Slider.Slider.Maximum = 1.0
        Slider.SetSliderValue(Default)

Tparameters = u
a = Tparameters
# ---------- end python ----------
# Load Line
pt = Point(<point referenced from the Rhino model>)
Z = UnitZ(Factor=1)
multiplication = Multiplication(A=number_of_panels, B=applied_force_magnitude)
rev = Reverse(Vector=Z)
amp = Amplitude(Vector=rev, Amplitude=multiplication)
move = Move(Geometry=pt, Motion=amp)  # -> Geometry, Transform
addition = Addition(A=number_of_panels, B=1)
ln = Line(StartPoint=pt, EndPoint=move.Geometry)
Z_2 = UnitZ(Factor=1)
# Load Line Points
divide = DivideCurve(Curve=ln, Count=addition, Kinks=False)  # -> Points, Tangents, Parameters
# Load Line Midpoint
eval = EvaluateCurve(Curve=ln, Parameter="0.5")  # -> Point, Tangent, Angle
# Form
pt_2 = Point(<point referenced from the Rhino model>)
rev_2 = Reverse(Vector=Z_2)
Y = UnitY(Factor=1)
amp_2 = Amplitude(Vector=rev_2, Amplitude=applied_force_magnitude)
shift = ShiftList(List=divide.Points, Shift=1, Wrap=False)
shift_2 = ShiftList(List=shift, Shift=-1, Wrap=False)
python_2 = PythonScript(x=list, y=eval.Point, z=shift_2)  # -> out, a; inputs y: Point3d
# ---------- python_2: Python ----------
import rhinoscriptsyntax as rs

OneMidpoint = y
MultiMidpoint = z

if x == 1:
    a = MultiMidpoint

if x == 2:
    a = OneMidpoint
# ---------- end python_2 ----------
circle = CircleCNR(Center=python_2.a, Normal=Y, Radius=chord_force_magnitude)
eval_2 = EvaluateCurve(Curve=reparameterize(circle), Parameter=python.a)  # -> Point, Tangent, Angle
shift_3 = ShiftList(List=eval_2.Point, Shift=1, Wrap=False)
# Bottom Chord Points (FP)
ln_2 = Line(StartPoint=eval.Point, EndPoint=eval_2.Point)
ln_3 = Line(StartPoint=eval_2.Point, EndPoint=shift_2)
python_top_chord_form = PythonScript(x=ln_3, y=pt_2, z=panel_width)  # -> out, a; inputs x: list of Curve, y: Point3d
# ---------- python_top_chord_form: Python ----------
import rhinoscriptsyntax as rs

Lines = x
StartPt = y
Width = z

p1 = StartPt
Points = []
Points.append(p1)

for i in range(len(Lines)):
    Line = Lines[i]
    stpt = rs.CurveStartPoint(Line)
    edpt = rs.CurveEndPoint(Line)
    DX = stpt.X-edpt.X
    DZ = stpt.Z-edpt.Z
    slope = DZ/DX
    dz = slope*Width
    p2 = rs.Str2Pt((p1.X+Width,p1.Y,p1.Z+dz))
    Points.append(p2)
    p1 = p2

a = Points
# ---------- end python_top_chord_form ----------
force = ForcePoint(Point=python_top_chord_form.a, Direction=amp_2)
shift_4 = ShiftList(List=python_top_chord_form.a, Shift=1, Wrap=False)
# Top Chord Lines (Form)
ln_4 = Line(StartPoint=python_top_chord_form.a, EndPoint=shift_4)
ln_5 = Line(StartPoint=eval_2.Point, EndPoint=shift_3)
# Top Chord (FP)
len = Length(Curve=ln_3)
len_2 = Length(Curve=ln_4)
len_3 = Length(Curve=ln_2)
# Web Lines (FP)
len_4 = Length(Curve=ln_5)
python_bottom_chord_form = PythonScript(x=ln_2, y=pt_2, z=ln_5, u=python_top_chord_form.a)  # -> out, a; inputs x: list of Curve, y: Point3d, z: list of Curve, u: list of Point3d
# ---------- python_bottom_chord_form: Python ----------
import rhinoscriptsyntax as rs

BOTLines = x
StartPt = y
WebLines = z
TCPoints = u

p1 = StartPt
Points = []
Points.append(p1)


for i in range(len(BOTLines)):
    XVal = 1
    BotLine = BOTLines[i]
    top1 = rs.CurveStartPoint(BotLine)
    top2 = rs.CurveEndPoint(BotLine)
    dx = top1.X-top2.X
    dz = top1.Z-top2.Z
    slope = dz/dx
    p2 = rs.Str2Pt((p1.X+XVal,p1.Y,p1.Z+slope))
    Line1 = rs.AddLine(p1,p2)
    P1 = TCPoints[i+1]
    WebLine = WebLines[i]
    web1 = rs.CurveStartPoint(WebLine)
    web2 = rs.CurveEndPoint(WebLine)
    DX = web1.X-web2.X
    DZ = web1.Z-web2.Z
    try:
        SLOPE = DZ/DX
    except:
        SLOPE = 1
        XVal = 0
    P2 = rs.Str2Pt((P1.X+XVal,P1.Y,P1.Z+SLOPE))
    Line2 = rs.AddLine(P1,P2)
    Intersect = rs.LineLineIntersection(Line1,Line2)
    NewPoint = Intersect[0]
    Points.append(NewPoint)
    p1 = NewPoint
    rs.DeleteObject(Line1)
    rs.DeleteObject(Line2)



a = Points
# ---------- end python_bottom_chord_form ----------
shift_5 = ShiftList(List=python_bottom_chord_form.a, Shift=1, Wrap=False)
# Web Lines (Form)
ln_6 = Line(StartPoint=python_top_chord_form.a, EndPoint=python_bottom_chord_form.a)
# Bottom Chord Lines (Form)
ln_7 = Line(StartPoint=python_bottom_chord_form.a, EndPoint=shift_5)

addition_2 = Addition(A=number_of_panels, B=3)
addition_3 = Addition(A=load_line_labels, B=load_line_midpoint_label)
X = UnitX(Factor=1)
amp_3 = Amplitude(Vector=X, Amplitude=addition_3)
seq = Sequence(Count=addition_2, CharPool="ABCDEFGHIJKLMNOPQRSTUVWXYZ", Format="{0}")
move_2 = Move(Geometry=eval.Point, Motion=amp_3)  # -> Geometry, Transform
rev_3 = ReverseList(List=seq)
item = ListItem(List=rev_3, Index=0, Wrap=True)
tag = TextTag(Location=move_2.Geometry, Text=item)

X_2 = UnitX(Factor=1)
amp_4 = Amplitude(Vector=X_2, Amplitude=number_point_labels_distance)
move_3 = Move(Geometry=eval_2.Point, Motion=amp_4)  # -> Geometry, Transform
points = PointList(Points=move_3.Geometry)

# ----
# Load Line Labels
X_3 = UnitX(Factor=1)
addition_4 = Addition(A=number_of_panels, B=2)
amp_5 = Amplitude(Vector=X_3, Amplitude=load_line_labels)
seq_2 = Sequence(Count=addition_4, CharPool="ABCDEFGHIJKLMNOPQRSTUVWXYZ", Format="{0}")
move_4 = Move(Geometry=divide.Points, Motion=amp_5)  # -> Geometry, Transform
tag_2 = TextTag(Location=move_4.Geometry, Text=seq_2)

len_5 = Length(Curve=ln_6)
len_6 = Length(Curve=ln_7)
# Webs
multiplication_2 = Multiplication(A=len_5, B=len_4)
# Top Chord
multiplication_3 = Multiplication(A=len_2, B=len)
# Bottom Chord
multiplication_4 = Multiplication(A=len_6, B=len_3)
ma = MassAddition(Input=multiplication_2)  # -> Result, PartialResults
ma_2 = MassAddition(Input=multiplication_3)  # -> Result, PartialResults
ma_3 = MassAddition(Input=multiplication_4)  # -> Result, PartialResults
neg = Negative(Value=ma.Result)
neg_2 = Negative(Value=ma_2.Result)
load_path_webs = Panel(neg)
load_path_top_chord = Panel(neg_2)
load_path_bottom_chord = Panel(ma_3.Result)
addition_5 = Addition(A=ma.Result, B=ma_2.Result, C=ma_3.Result)
round = Round(Number=addition_5)  # -> Nearest, Floor, Ceiling
total_load_path = Panel(addition_5)
# Load Path Text
X_4 = UnitX(Factor=1)
amp_6 = Amplitude(Vector=X_4, Amplitude=total_load_path_label_distance)
pt_3 = Point(<point referenced from the Rhino model>)
concat = Concatenate(FragmentA="Total Load Path: ", FragmentB=round.Nearest)
move_5 = Move(Geometry=pt_3, Motion=amp_6)  # -> Geometry, Transform
tag_3 = TextTag(Location=move_5.Geometry, Text=concat)
