# Grasshopper definition Lenticular.gh (Grasshopper 0.9.76)
# plug-ins: Python Interpreter, Topos5

# ----
# TEXT TAG POSITIONS
load_line_label_distance = Slider(8.19, range=0..50)
total_load_path_label_distance = Slider(34.215, range=0..100)

# ----
# MANIPULATE FORCE POLYGON
# OPTION 1. Constant Force in VERTICAL Members
# OPTION 2. Constant Force in CHORD Members
# OPTION 3. FREEFORM Lenticular
list = ValueList({"1. Constant Force in Vertical Members": 1, "2. Constant Force in Chord Members": 2, "3. Freeform Lenticular": 3}, selected="2. Constant Force in Chord Members")
horizontal_component_of_chord_forces = Slider(154.62, range=0..1000)
click_to_create_sliders = Button()
constant_chord_force_magnitude = Slider(52.55, range=0..500)

# ----
# Load Line
pt = Point(<point referenced from the Rhino model>)
Z = UnitZ(Factor=1)
rev = Reverse(Vector=Z)
X = UnitX(Factor=1)
# Constant Chord Force
rev_2 = Reverse(Vector=X)
amp = Amplitude(Vector=rev_2, Amplitude=horizontal_component_of_chord_forces)
# Form
pt_2 = Point(<point referenced from the Rhino model>)
Z_2 = UnitZ(Factor=1)
rev_3 = Reverse(Vector=Z_2)

# ----
# BOUNDARY CONDITIONS
number_of_panels = Slider(6, range=0..20)
panel_width = Slider(29.08, range=0..50)
applied_force_magnitude = Slider(23, range=0..50)

multiplication = Multiplication(A=number_of_panels, B=applied_force_magnitude)
multiplication_2 = Multiplication(A=number_of_panels, B=panel_width)
multiplication_3 = Multiplication(A=number_of_panels, B=applied_force_magnitude)

truss_length = Panel(multiplication_2)
total_force = Panel(multiplication_3)

amp_2 = Amplitude(Vector=rev, Amplitude=multiplication)
move = Move(Geometry=pt, Motion=amp_2)  # -> Geometry, Transform
addition = Addition(A=number_of_panels, B=1)
ln = Line(StartPoint=pt, EndPoint=move.Geometry)
# Midpoint
eval = EvaluateCurve(Curve=ln, Parameter="0.5")  # -> Point, Tangent, Angle
# Load Line Points
divide = DivideCurve(Curve=ln, Count=addition, Kinks=False)  # -> Points, Tangents, Parameters
shift = ShiftList(List=divide.Points, Shift=1, Wrap=False)
shift_2 = ShiftList(List=shift, Shift=-1, Wrap=False)
ln_2 = Line(StartPoint=shift_2, EndPoint=eval.Point)
# Smaller Midpoints
eval_2 = EvaluateCurve(Curve=ln_2, Parameter="0.5")  # -> Point, Tangent, Angle
# Freeform Lenticular
python = PythonScript(
    x=click_to_create_sliders,
    y=eval_2.Point,
    z=[Slider(50, range=0..70), Slider(50, range=0..70), Slider(50, range=0..70), Slider(50, range=0..70), Slider(50, range=0..70), Slider(50, range=0..70)])  # -> out, a; inputs y: list of Point3d, z: list
# ---------- python: Python ----------
import Grasshopper as gh
import System.Drawing as sd
import rhinoscriptsyntax as rs

comp = ghenv.Component
ghdoc = comp.OnPingDocument()
canvas = gh.Instances.ActiveCanvas

Midpoints = y
Default = 50

if x == True:
    for i in range(len(Midpoints)):
        Slider = gh.Kernel.Special.GH_NumberSlider()
        Mag = Default
        ghdoc.AddObject(Slider,False,ghdoc.ObjectCount+1)
        targetInput = comp.Params.Input[2]
        thisPivot = targetInput.Attributes.Pivot
        Slider.Attributes.Pivot = sd.PointF(thisPivot.X-400,thisPivot.Y+(25*(i+1)))
        targetInput.AddSource(Slider)
        Slider.Slider.Maximum = 70
        Slider.SetSliderValue(Default)

xdist = z

NewPoints = []
for j in range(len(Midpoints)):
    MDPT = Midpoints[j]
    dist = xdist[j]
    POINT = rs.Str2Pt((MDPT.X-dist,MDPT.Y,MDPT.Z))
    NewPoints.append(POINT)

a = NewPoints
# ---------- end python ----------
# Number Points
move_2 = Move(Geometry=eval_2.Point, Motion=amp)  # -> Geometry, Transform
python_2 = PythonScript(x=shift_2, y=eval_2.Point, z=constant_chord_force_magnitude)  # -> out, a; inputs x: list of Point3d, y: list of Point3d
# ---------- python_2: Python ----------
import rhinoscriptsyntax as rs
import math

LoadLinePts = x
Midpoints = y
MaxForce = z

NumberPoints = []
for i in range(len(Midpoints)):
    MDPT = Midpoints[i]
    ydist = rs.Distance(LoadLinePts[i],MDPT)
    angle = math.asin(ydist/MaxForce)
    xdist = MaxForce*math.cos(angle)
    point = rs.Str2Pt((MDPT.X-xdist,MDPT.Y,MDPT.Z))
    NumberPoints.append(point)

a = NumberPoints
# ---------- end python_2 ----------
# Number Points
# (on load line)
python_3 = PythonScript(x=list, y=move_2.Geometry, z=python_2.a, u=python.a)  # -> out, a
# ---------- python_3: Python ----------
import rhinoscriptsyntax as rs

if x == 1:
    a = y

if x == 2:
    a = z


if x == 3:
    a = u
# ---------- end python_3 ----------
amp_3 = Amplitude(Vector=rev_3, Amplitude=applied_force_magnitude)
shift_3 = ShiftList(List=python_3.a, Shift=1, Wrap=False)
shift_4 = ShiftList(List=python_3.a, Shift=-1, Wrap=False)
shift_5 = ShiftList(List=python_3.a, Shift=-1, Wrap=False)
shift_6 = ShiftList(List=python_3.a, Shift=1, Wrap=False)
# Top Chord
ln_3 = Line(StartPoint=python_3.a, EndPoint=shift_2)
# Bottom Chord
ln_4 = Line(StartPoint=python_3.a, EndPoint=eval.Point)
# Webs
ln_5 = Line(StartPoint=shift_4, EndPoint=shift_3)
python_4 = PythonScript(x=pt_2, y=ln_3, z=panel_width, u=ln_5, v=ln_4)  # -> out, a, b; inputs x: Point3d, y: list of Curve, u: list of Curve, v: list of Curve
# ---------- python_4: Python ----------
import rhinoscriptsyntax as rs

StartPt = x     # Leftpoint of form
TCLines = y     # Top chord lines
DX = z          # Panel width
Webs = u        # Web lines
BCLines = v     # Bottom chord lines

p1 = StartPt
Points = []
Points.append(p1)
for i in range(len(TCLines)):
    Line = TCLines[i]
    Stpt = rs.CurveStartPoint(Line)
    Edpt = rs.CurveEndPoint(Line)
    dx = Stpt.X-Edpt.X
    dz = Stpt.Z-Edpt.Z
    slope = dz/dx
    DZ = slope*DX
    p2 = rs.Str2Pt((p1.X+DX,p1.Y,p1.Z+DZ))
    Points.append(p2)
    p1 = p2

a = Points      # Top chord

PointsBot = []
PointsBot.append(StartPt)
p1 = Points[0]
for j in range(len(BCLines)-1):
    DX = 1
    BC = BCLines[j]
    bc1 = rs.CurveStartPoint(BC)
    bc2 = rs.CurveEndPoint(BC)
    bc_dx = bc1.X-bc2.X
    bc_dz = bc1.Z-bc2.Z
    bc_slope = bc_dz/bc_dx
    p2 = rs.Str2Pt((p1.X+DX,p1.Y,p1.Z+(bc_slope*DX)))
    line1 = rs.AddLine(p1,p2)
    Web = Webs[j]
    web1 = rs.CurveStartPoint(Web)
    web2 = rs.CurveEndPoint(Web)
    web_dx = web1.X-web2.X
    web_dz = web1.Z-web2.Z
    try:
        web_slope = web_dz/web_dx
    except:
        web_slope = 1
        DX = 0
    P1 = Points[j+1]
    P2 = rs.Str2Pt((P1.X+DX, P1.Y, P1.Z+(web_slope)))
    line2 = rs.AddLine(P1,P2)
    Inter = rs.LineLineIntersection(line1,line2)
    InterPT = Inter[0]
    PointsBot.append(InterPT)
    rs.DeleteObject(line1)
    rs.DeleteObject(line2)
    p1 = InterPT

b = PointsBot   # Bottom chord
# ---------- end python_4 ----------
shift_7 = ShiftList(List=python_4.b, Shift=1, Wrap=False)
shift_8 = ShiftList(List=python_4.a, Shift=1, Wrap=False)
force = ForcePoint(Point=python_4.a, Direction=amp_3)
# Bottom Chord
ln_6 = Line(StartPoint=python_4.b, EndPoint=shift_7)
# Vertical Webs
ln_7 = Line(StartPoint=python_4.a, EndPoint=python_4.b)
# Top Chord
ln_8 = Line(StartPoint=python_4.a, EndPoint=shift_8)
len = Length(Curve=ln_4)
len_2 = Length(Curve=ln_3)
# Distance between number points
dist = Distance(PointA=shift_5, PointB=shift_6)
len_3 = Length(Curve=ln_6)
len_4 = Length(Curve=ln_8)
len_5 = Length(Curve=ln_7)
# Shifting to remove zeros
shift_9 = ShiftList(List=len_5, Shift=1, Wrap=False)
# Bottom
multiplication_4 = Multiplication(A=len, B=len_3)
# Top
multiplication_5 = Multiplication(A=len_2, B=len_4)
shift_10 = ShiftList(List=shift_9, Shift=-1, Wrap=False)
# Vertical
multiplication_6 = Multiplication(A=dist, B=shift_10)
ma = MassAddition(Input=multiplication_6)  # -> Result, PartialResults
ma_2 = MassAddition(Input=multiplication_4)  # -> Result, PartialResults
ma_3 = MassAddition(Input=multiplication_5)  # -> Result, PartialResults
neg = Negative(Value=ma.Result)
neg_2 = Negative(Value=ma_3.Result)
load_path_vertical_members = Panel(neg)
load_path_bottom_chord = Panel(ma_2.Result)
load_path_top_chord = Panel(neg_2)

addition_2 = Addition(A=number_of_panels, B=3)
seq = Sequence(Count=addition_2, CharPool="ABCDEFGHIJKLMNOPQRSTUVWXYZ", Format="{0}")
rev_4 = ReverseList(List=seq)
X_2 = UnitX(Factor=1)
item = ListItem(List=rev_4, Index=0, Wrap=True)
amp_4 = Amplitude(Vector=X_2, Amplitude=load_line_label_distance)
move_3 = Move(Geometry=eval.Point, Motion=amp_4)  # -> Geometry, Transform
tag = TextTag(Location=move_3.Geometry, Text=item)

# ----
# Load Line Labels
addition_3 = Addition(A=number_of_panels, B=2)
X_3 = UnitX(Factor=1)
amp_5 = Amplitude(Vector=X_3, Amplitude=load_line_label_distance)
seq_2 = Sequence(Count=addition_3, CharPool="ABCDEFGHIJKLMNOPQRSTUVWXYZ", Format="{0}")
move_4 = Move(Geometry=divide.Points, Motion=amp_5)  # -> Geometry, Transform
tag_2 = TextTag(Location=move_4.Geometry, Text=seq_2)

addition_4 = Addition(A=ma.Result, B=ma_2.Result, C=ma_3.Result)
total_load_path = Panel(addition_4)
round = Round(Number=addition_4)  # -> Nearest, Floor, Ceiling
concat = Concatenate(FragmentA="Total Load Path:", FragmentB=round.Nearest)

# ----
# Load Path Value
pt_3 = Point(<point referenced from the Rhino model>)
X_4 = UnitX(Factor=1)
amp_6 = Amplitude(Vector=X_4, Amplitude=total_load_path_label_distance)
move_5 = Move(Geometry=pt_3, Motion=amp_6)  # -> Geometry, Transform
tag_3 = TextTag(Location=move_5.Geometry, Text=concat)
