# Grasshopper definition RESHAPE_v2.gh (Grasshopper 0.9.76)
# plug-ins: Python Interpreter

# ----
# 2. SPECIFY SUPPORTS
# 2.1 Double-click "FALSE" to start user-prompts in Rhino Command Line
# 2.2 Double-click "TRUE" to complete data collection.
# 2.3 To redo, repeat steps 2.1-2.2.
# This erases previous data and saves new information.
# 2.4 Adjust Support Vector Display
list = ValueList({"Hidden": 0, "Visible": 1}, selected="Visible")
support_vector_length = Slider(10, range=0..20)
support_vector_width = Slider(4, range=0..20)
collect = BooleanToggle(False)

# ----
# 3. SPECIFY FORCES
# 3.1 Double-click "FALSE" to start user-prompts in Rhino Command Line
# 3.2 Double-click "TRUE" to complete specification process
# 3.3 To redo, repeat steps 2.1-2.2.
# This erases previous data and saves new information.
# 3.4 Adjust Support Vector Display
# 3.5 Create sliders for forces to adjust magnitude.
force_vector_length = Slider(11, range=0..20)
list_2 = ValueList({"Transparent": 0, "Visible": 1}, selected="Visible")
create_force_sliders = Button()
force_vector_width = Slider(2.9, range=0..20)
collect_2 = BooleanToggle(False)

# ----
# 4. BOW'S NOTATION (INNER)
# 4.1 Adjust inner bow's notation color
number_slider = Slider(128, range=0..255)

# ----
# 5. BOW'S NOTATION (OUTER)
# 5.1 Adjust outer bow's notation color
# 5.2 Adjust offset distance of outer bow's notation labels from perimeter
# 5.3 Adjust the length of the line of action at the nodes [FOR DEBUGGING]
# RULE: OffsetPerimDist > Node LOA Length
number_slider_2 = Slider(0, range=0..255)
offsetperimdist = Slider(-1.95, range=-10..10)
node_loa_length = Slider(3, range=0..10)

# ----
# 7. GENERATE FORCE POLYGON
# 7.1 Click to draw (or redraw) the force polygons for the respective loads
# 7.2 Adjust the distance of the labels of the respective force polygons
distance_of_ll_labels_gravity = Slider(0.6, range=0.2..10)
update_force_polygon_lateral = Button()
update_force_polygon_gravity = Button()
update_force_polygon_combined = Button()
distance_of_ll_labels_lateral = Slider(8.3, range=0.2..10)
distance_of_ll_labels_combined = Slider(1.7, range=0.2..10)

# ----
# 6. GENERATE LOAD LINE
# 6.1 Set the scale for the load line (force per unit length)
# 6.2 Adjust the x-position of the start of the gravity and combined load lines
# (Relative to the point specified for the start of the load line [lateral])
# 6.3 Adjust the position of the load line titles in the x- and z-directions
# 6.4 Specify the amount of horizontal load taken by the left support (OPTIONAL)
tlp_label_z = Slider(4.721, range=0..50)
load_line_scale = Slider(2, range=1..100)
gravity_load_line_position = Slider(57, range=-100..100)
combined_load_line_position = Slider(63, range=-100..100)
ll_label_z = Slider(-46, range=-100..100)
ll_label_x = Slider(-5, range=-100..100)
horizontal_taken_by_left_support = Slider(0.31, range=0..1)

# ----
# 1. INDEX GEOMETRY
# 1.1 Activate [REC] Component
# Adjust color of truss lines
# (Default Black = 0,0,0)
# 1.2 Right Click; Set Multiple Pts
# 1.3 Right Click; Set Multiple Curves
# 1.4 De-active [REC] Component above
# 1.5 Right click; Set one point
load_line_start_pt_lateral = Point(<point referenced from the Rhino model>)
crv_truss_members = Curve([<curve referenced from the Rhino model> x21])
pt_truss_nodes = Point([<point referenced from the Rhino model> x12])

# ----
# 1. {a l g o r i t h m}
pdecon = Deconstruct(Point=pt_truss_nodes)  # -> XComponent, YComponent, ZComponent
id = Guid(crv_truss_members)
end = EndPoints(Curve=id)  # -> Start, End
pt = ConstructPoint(XCoordinate=pdecon.XComponent, YCoordinate=pdecon.YComponent, ZCoordinate=pdecon.ZComponent)
rgb = ColourRGB(Alpha=255, Red=Slider(0, range=0..255), Green=Slider(0, range=0..255), Blue=Slider(0, range=0..255))
crossref = CrossReference(ListA=pt, ListB=pt, CrossMode=1)  # -> ListA, ListB
material = CreateMaterial(Diffuse=rgb, Specular=RGB(255, 255, 255), Emission=RGB(0, 0, 0), Transparency=0, Shine=0)
py_match_indices = PythonScript(x=crossref.ListA, y=crossref.ListB, u=end.Start, v=end.End)  # -> a; inputs x: list of Point3d, y: list of Point3d, u: list of Point3d, v: list of Point3d
# ---------- py_match_indices: Python ----------
import rhinoscriptsyntax as rs
import scriptcontext as sc
import Rhino

S_big = x       # Start points of big list          STRING
E_big = y       # End points of the big list

S_actual = u    # Start points of actual members    GUID
E_actual = v    # End points of actual members

Start = []      # Final Start Points
End = []        # Final End Points

Indices = []    # Storing indices of matching points

for i in range(len(x)):
    s = S_big[i]
    e = E_big[i]
    for j in range(len(u)):
        sa = S_actual[j]
        ea = E_actual[j]
        if s == sa and e == ea :
            Indices.append(i)

a = Indices
# ---------- end py_match_indices ----------
point_indices = PointList(Points=pt_truss_nodes, Size=Slider(2, range=1..10))

rec = DataRecorder(py_match_indices, DataLimit=-10, RecordData=False)

# ----
# 2. {a l g o r i t h m}
py_specify_supports = PythonScript(x=collect, y=pt)  # -> a; inputs y: list of Point3d
# ---------- py_specify_supports: Python ----------
import rhinoscriptsyntax as rs
import scriptcontext as sc
import Rhino

STOP = 0 
REF = y

# String options lists
Types = ['Roller','Pin','Fixed']
YN = ['Yes','No']

#-------- Collect Points

if x == True:
    Supports = []
    while STOP < 1000:
        # Prompt user to specify support conditions
        P = rs.GetPoint('Select Support Node')
        T = rs.GetString('Specify Type:',None,Types)
        D = rs.GetInteger('Specify Orientation',90)
        # Store point information in appropriate lists
        for i in range(len(REF)):
            if P == rs.Str2Pt(REF[i]):
                Supports.append((T,i,D))
        X = rs.GetString('Specify Another Support?',None,YN)
        if X == 'No':
            STOP = 1000

a = Supports    # Type, Index, Direction
# ---------- end py_specify_supports ----------
rgb_2 = ColourRGB(Alpha=list, Red=Slider(0, range=0..255), Green=Slider(0, range=0..255), Blue=Slider(0, range=0..255))
supports_type_index_angle = Panel(py_specify_supports)
X = UnitX(Factor=1)
py_draw_support_vectors = PythonScript(x=py_specify_supports, y=X, v=support_vector_length, w=pt)  # -> a, b, c, d; inputs x: list, y: Vector3d, w: list of Point3d
# ---------- py_draw_support_vectors: Python ----------
import rhinoscriptsyntax as rs
import scriptcontext as sc
import Rhino

rs.AddGroup("Supports")

#-------- Draw Support Symbols

Supports = x    # [type,index,angle]
UnitXVec = y
Scale = v
RefPts = w

SupportNodes = []
SupportVectors = []
SupportVectorAnchors = []
ActiveIndices = []
for i in range(len(Supports)):
    degree = Supports[i][2]
    supportvector = UnitXVec
    supportvector = rs.VectorScale(supportvector,Scale)
    supportvector = rs.VectorRotate(supportvector,-degree,(0,1,0))
    vectortrans = rs.VectorReverse(supportvector)
    index = Supports[i][1]
    psupport = RefPts[index]
    panchor = rs.PointAdd(psupport,vectortrans)
    SupportVectors.append(supportvector)
    SupportVectorAnchors.append(panchor)
    SupportNodes.append(psupport)
    ActiveIndices.append(index)

a = SupportVectorAnchors    # Point3d
b = SupportVectors          # Vector3d
c = SupportNodes
d = ActiveIndices


#h = S_build # For labeling supports and forces
#i = all     # For labeling members
# ---------- end py_draw_support_vectors ----------
support_vector_display = VectorDisplayEx(Point=py_draw_support_vectors.a, Vector=py_draw_support_vectors.b, Colour=rgb_2, Width=support_vector_width)
support_vector_anchors = Panel(py_draw_support_vectors.a)
support_vectors = Panel(py_draw_support_vectors.b)

int = Integer(rec)
py_compile_line_endpts = PythonScript(x=crossref.ListA, y=crossref.ListB, z=int)  # -> out, a, b; inputs x: list, y: list, z: list
# ---------- py_compile_line_endpts: Python ----------
Start = []
End = []

for i in z:
    Start.append(x[i])
    End.append(y[i])

a = Start
b = End
# ---------- end py_compile_line_endpts ----------
ln = Line(StartPoint=py_compile_line_endpts.a, EndPoint=py_compile_line_endpts.b)
preview = CustomPreview(Geometry=ln, Shader=material)

# ----
# 4. {a l g o r i t h m}
# Creating series of inner number labels
py_detect_triangles = PythonScript(x=pt_truss_nodes, y=ln)  # -> out, a, b, c; inputs x: list of Point3d, y: list of Curve
# ---------- py_detect_triangles: Python ----------
import rhinoscriptsyntax as rs
import scriptcontext as sc
import Rhino

sc.doc = Rhino.RhinoDoc.ActiveDoc

RefPt = x       # Referenced points, list access, typehint: Point3d
RefLn = y       # Referenced lines, list access, typehint: Curve

# ---------- Compiling information about line segments

Lines = []      # Compiled information of lines
LStart = []     # Start point of each line
LEnd = []       # End point of each line
LPoints = []

for i in range(len(RefLn)):
    Lines.append(RefLn[i])
    LStart.append(rs.CurveStartPoint(RefLn[i]))
    LEnd.append(rs.CurveEndPoint(RefLn[i]))
    sr = rs.CurveStartPoint(RefLn[i])
    er = rs.CurveEndPoint(RefLn[i])
    point  = [sr,er]
    point = sorted(point)
    LPoints.append(point)

# ----------- Detecting triangular faces

Faces = []                  # Faces
Vertices = []
p0 = []
p1 = []
p2 = []

for i in range(len(RefPt)):
    p0 = RefPt[i]           # Starting point
    Seg = []                # Segments connecting to current point

    for line in range(len(Lines)):
        if p0 == LStart[line] or p0 == LEnd[line]:
            Seg.append(Lines[line])
            
    for s in range(len(Seg)):
        s1 = Seg[s]             # First line segment
        st = rs.CurveStartPoint(s1)
        en = rs.CurveEndPoint(s1)
        if p0 == st:      
            p1 = en             # Obtaining opposite point of line as p1
        else:
            p1 = st
            
        Seg2 = []
        
        for L in range(len(Lines)):                 # Segments connected to p1
            if p1 == LStart[L] or p1 == LEnd[L]:
                Seg2.append(Lines[L])
        
        for S in Seg2:
            if S in Seg:
                Seg2.remove(S)
        
        for S in range(len(Seg2)):
            s2 = Seg2[S]                            # Second line segment
            st2 = rs.CurveStartPoint(s2)
            en2 = rs.CurveEndPoint(s2)
            if p1 == st2:
                p2 = en2
            else:
                p2 = st2
            Points1 = [p0,p1,p2]
            Points2 = rs.SortPoints(Points1,True,0)
            Points2.append(Points2[0])
            V1 = rs.VectorCreate(Points2[0],Points2[1])
            V1 = rs.VectorUnitize(V1)
            V2 = rs.VectorCreate(Points2[1],Points2[2])
            V2 = rs.VectorUnitize(V2)
            if V1 != V2:
                Tri = rs.AddPolyline(Points2)
                rs.AddObjectToGroup(Tri,"DeleteGroup")
                Faces.append(Tri)
                Vertices.append(Points2)

rs.AddGroup("DeleteGroup")
rs.AddObjectsToGroup(Faces,"DeleteGroup")

# ------ Deletes polyline curves that created new line segments
# ------ Creates a centroid for each triangular face detected

import System.Guid as Guid
import Grasshopper as gh

doc = Rhino.RhinoDoc.ActiveDoc
convert = gh.Kernel.GH_Convert

Curves = []
Centroid = []
Vertices2 = []

for i in range(len(Faces)):
    ID = convert.GetCurveFromDocument(doc,Faces[i])
    FACE = ID[1]
    Broken = rs.ExplodeCurves(FACE)
    rs.AddObjectsToGroup(Broken,"DeleteGroup")
    BRPoints = []
    for b in Broken:
        sb = rs.CurveStartPoint(b)
        eb = rs.CurveEndPoint(b)
        point = [sb,eb]
        point = sorted(point)
        BRPoints.append(point)
    DUP = 0
    for bp in BRPoints:
        if bp not in LPoints:       # Excludes polylines that created new lines
            DUP = DUP + 1
        else:
            DUP = DUP + 0
    if DUP == 0:
        if rs.IsCurveClosed(FACE):
            C = rs.CurveAreaCentroid(FACE)
            if C[0] not in Centroid:
                Curves.append(FACE)
                Centroid.append(C[0])
                Vertices2.append(Vertices[i])

# ----- Deleting centroids of larger overlapping faces

Delete = []

for c in range(len(Centroid)):
    pt = Centroid[c]
    tri = Curves[c]
    a1 = rs.CurveArea(tri)
    for t in Curves:
        if tri != t:
            if rs.PointInPlanarClosedCurve(pt,t) > 0:
                a2 = rs.CurveArea(t)
                if a1 > a2:
                    Delete.append(c)

for i in Delete:
    Centroid.remove(Centroid[i])
    Curves.remove(Curves[i])


# ------ Remove objects constructed for analysis

b = rs.ObjectsByGroup("DeleteGroup")
for i in b:
    rs.DeleteObject(i)

a = Centroid
b = sorted(Centroid)
c = Curves
# ---------- end py_detect_triangles ----------
nurbs = NurbsCurve(Vertices=py_detect_triangles.b, Degree=Slider(5, range=1..10), Periodic=False)  # -> Curve, Length, Domain
inner_text_dots = Button()
crv_cp = CurveClosestPoint(Point=py_detect_triangles.b, Curve=nurbs.Curve)  # -> Point, Parameter, Distance
py_bow_s_notation_inner = PythonScript(x=py_detect_triangles.b, y=crv_cp.Parameter, z=inner_text_dots)  # -> out, a; inputs x: list of Point3d, y: list
# ---------- py_bow_s_notation_inner: Python ----------
import rhinoscriptsyntax as rs

Sorted = x  # Sorted midpoints
Order = y   # Nurbs curve parameters

BOTH = []
for i in range(len(Sorted)):
    BOTH.append((Order[i],Sorted[i]))

Both = sorted(BOTH)

Points = []
for i in range(len(Both)):
    os = Both[i]
    pt = os[1]
    Points.append(pt)

rs.AddGroup("InnerTextDots")

if z == True:
    for i in range(len(Points)):
        TXT = rs.AddTextDot(i+1,Points[i])
        rs.AddObjectToGroup(TXT,"InnerTextDots")

a = Points
# ---------- end py_bow_s_notation_inner ----------
lng = ListLength(List=py_bow_s_notation_inner.a)
series = Series(Start="1", Step=1, Count=lng)
rgb_3 = ColourRGB(Alpha=255, Red=Slider(128, range=0..255), Green=number_slider, Blue=Slider(128, range=0..255))
int_2 = Integer(series)
inner_bow_s_label = TextTag(Location=py_bow_s_notation_inner.a, Text=int_2, Colour=rgb_3)
py_inner_bows_points = PythonScript(x=py_bow_s_notation_inner.a, y=int_2)  # -> out, a; inputs x: list of Point3d, y: list
# ---------- py_inner_bows_points: Python ----------
# x = Location points
# y = Character labels

InnerBows = []
for i in range(len(x)):
    InnerBows.append((x[i],y[i]))

a = InnerBows
# ---------- end py_inner_bows_points ----------

# ----
# 3. {a l g o r i t h m}
rgb_4 = ColourRGB(Alpha=list_2, Red=Slider(121, range=0..255), Green=Slider(121, range=0..255), Blue=Slider(121, range=0..255))
py_saving_force_info = PythonScript(x=collect_2, y=pt, z=py_draw_support_vectors.d)  # -> out, a; inputs y: list of Point3d, z: list
# ---------- py_saving_force_info: Python ----------
import rhinoscriptsyntax as rs
import scriptcontext as sc
import math 
import Rhino

STOP = 0                    # For the While loop
stop = 0
RefPts = y                  # Referenced points

YN = ['Yes','No']           # String options lists


#-------- Collect Points

if x == True:
    Forces = []
    ActiveIndices = z
    while STOP < 1000:
        # Prompt user to specify forces
        P = rs.GetPoint('Select Node of Applied Force')
        M = rs.GetInteger('Specify Magnitude')
        D = rs.GetInteger('Specify Orientation',270)
        # Store information in appropriate lists
        for i in range(len(RefPts)):
            if P == rs.Str2Pt(RefPts[i]):
                Forces.append((i,M,D))
                ActiveIndices.append(i)
        while stop < 100:
            R = rs.GetString('Duplcate Force?',None,YN)
            if R == 'Yes':
                p = rs.GetPoint('Select Node of Duplicate Force')
                m = M
                d = D
                for j in range(len(RefPts)):
                    if p == rs.Str2Pt(RefPts[j]):
                        Forces.append((j,m,d))
                        ActiveIndices.append(j)
            if R == 'No':
                stop = 100
        X = rs.GetString('Specify Another Force?',None,YN)
        if X == 'No':
            STOP = 1000
        stop = 0
    for rp in range(len(RefPts)):
        if rp not in ActiveIndices:
            Forces.append((rp,0,270))


a = Forces  # Index, Magnitude, Direction
# ---------- end py_saving_force_info ----------
X_2 = UnitX(Factor=1)
a_forces_index_mag_angle = Panel(py_saving_force_info.a)

# ----
# 5. {a l g o r i t h m}
# Drawing the perimeter and offsetting it by distance specified by the slider.
# Extracting only the required amount of letters
# Drawing line of action by providing a starting point (the support or applied force node) and extending the line by length (slider) along the direction of the reverse of the support/force vector (away from the structure).
# 
# PROBLEM: If specified downward forces on bottom of structure rather than on top
enclosed_area = BoundarySurfaces(Edges=ln)
support_loa_length = Slider(5, range=0..10)
force_loa_length = Slider(4, range=0..20)
perimeter_edges = BrepEdges(Brep=enclosed_area)  # -> Naked, Interior, NonManifold
centroid = Area(Geometry=enclosed_area)  # -> Area, Centroid
py_vertices_for_polyline = PythonScript(x=perimeter_edges.Naked)  # -> out, a; inputs x: list of Curve
# ---------- py_vertices_for_polyline: Python ----------
import rhinoscriptsyntax as rs

Edges = x

Vertices = []
for e in range(len(Edges)):
    p1 = rs.CurveStartPoint(Edges[e])
    Vertices.append(p1)

Vertices.append(Vertices[0])

a = Vertices
# ---------- end py_vertices_for_polyline ----------
perimeter_polyline = PolyLine(Vertices=py_vertices_for_polyline.a, Closed=False)
reverse_of_vector = Reverse(Vector=py_draw_support_vectors.b)
xz = XZPlane(Origin=Point(0, 0, 0))
py_obtain_perimeter_points = PythonScript(x=perimeter_polyline, y=pt_truss_nodes, z=node_loa_length)  # -> out, a, b; inputs x: Curve, y: list of Point3d
# ---------- py_obtain_perimeter_points: Python ----------
import rhinoscriptsyntax as rs

PerimLine = x
RefPts = y

# Obtaining Nodes on the Perimeter
PerimPts = []
for i in RefPts:
    if rs.IsPointOnCurve(PerimLine,i):
        PerimPts.append(i)

NodeLOA = z
# Creating LOAs for each node
NodeLOA_SP = []
NodeLOA_EP = []
for j in PerimPts:
    Coords = j
    StartPt = (Coords.X, Coords.Y, Coords.Z+NodeLOA)
    EndPt = (Coords.X, Coords.Y, Coords.Z-NodeLOA)
    NodeLOA_SP.append(rs.Str2Pt(StartPt))
    NodeLOA_EP.append(rs.Str2Pt(EndPt))

a = NodeLOA_SP
b = NodeLOA_EP
# ---------- end py_obtain_perimeter_points ----------
line = LineSDL(Start=py_draw_support_vectors.c, Direction=reverse_of_vector, Length=support_loa_length)
offsetperim = Offset(Curve=perimeter_polyline, Distance=offsetperimdist, Plane=xz, Corners=1)
node_loas = Line(StartPoint=py_obtain_perimeter_points.a, EndPoint=py_obtain_perimeter_points.b)
curve_intersection_points = CurveCurve(CurveA=offsetperim, CurveB=node_loas)  # -> Points, ParamsA, ParamsB
_100 = Integer(100)
outer_text_dots = Button()
flatten = FlattenTree(Tree=curve_intersection_points.ParamsA, Path="{0}")
alphabet = Sequence(Count=_100, CharPool="ABCDEFGHIJKLMNOPQRSTUVWXYZ", Format="{0}")
offset_perim_shattered_segments = Shatter(Curve=offsetperim, Parameters=flatten)
alphabet_100 = Sequence(Count=100, CharPool="ABCDEFGHIJKLMNOPQRSTUVWXYZ", Format="{0}")
py_midpoint_labels = PythonScript(x=offset_perim_shattered_segments, y=pt_truss_nodes, z=centroid.Centroid, u=alphabet, v=outer_text_dots)  # -> out, a, b, c, d, e; inputs x: list of Curve, y: list of Point3d, z: Point3d, u: list
# ---------- py_midpoint_labels: Python ----------
import rhinoscriptsyntax as rs
import Rhino.Geometry as rg
import math

ShatteredPerim = x

# Obtaining midpoints of each of the shattered segments
Midpoint = []
OffsetPerimSegments = []
OffsetSegmentPts = []
SortingSegments = []
for i in ShatteredPerim:
    mp = rs.CurveMidPoint(i)
    Midpoint.append(mp)
    OffsetPerimSegments
    sp = rs.CurveStartPoint(i)
    ep = rs.CurveEndPoint(i)
#    OffsetSegmentPts.append(sp)
#    OffsetSegmentPts.append(ep)
    OffsetSegmentPts.append(mp)
    SortingSegments.append((mp,i))

SortingSegments.sort()
SortedSegments = []
for ss in range(len(SortingSegments)):
    SortedSegments.append(SortingSegments[ss][1])
e = SortedSegments

# Obtaining bottom leftmost corner & drawing comparison vector
RefPts = y
RefPts.sort()
OffsetSegmentPts = rs.SortPoints(OffsetSegmentPts,True,1)
FormAnchorPt = OffsetSegmentPts[0]
Centroid = z
AnchorVector = rs.VectorCreate(Centroid,FormAnchorPt)

# Compiling angles of each segment midpoint vector
ZXPlane = rs.WorldZXPlane()
PtDist = []
PtDistB4 = []       # In order to sort the segments by the same pattern
for i in range(len(Midpoint)):
    P = Midpoint[i]
    V = rs.VectorCreate(Centroid,P)
    d = rg.Vector3d.VectorAngle(AnchorVector,V,ZXPlane)
    PtDist.append((d,P))
    PtDistB4.append((d))
PtDist.sort()
b = PtDistB4

# Extracting points to label in order according to angle from comparison vector
LabelPoints = []
for j in range(len(PtDist)):
    Point = PtDist[j][1]
    LabelPoints.append(Point)
a = LabelPoints

c = Centroid
d = FormAnchorPt

# ------ ADDING TEXT DOTS TO ACTUAL DOCUMENT
#rs.AddGroup("OuterTextDots")
#Alpha = u
#if v == True:
#    LabelPoints = []
#    for j in range(len(PtDist)):
#        Point = PtDist[j][1]
#        LabelPoints.append(Point)
#        TXT = rs.AddTextDot(Alpha[j],Point)
#        rs.AddObjectToGroup(TXT,"OuterTextDots")
#    OTD = rs.ObjectsByGroup("OuterTextDots")
#    white = [255,255,255]
#    for otd in OTD:
#        rs.ObjectColor(otd,white)
# ---------- end py_midpoint_labels ----------
lng_2 = ListLength(List=py_midpoint_labels.a)
rgb_5 = ColourRGB(Alpha=255, Red=number_slider_2, Green=Slider(0, range=0..255), Blue=Slider(0, range=0..255))
subtraction = Subtraction(A=lng_2, B="1")
subset = SubList(List=alphabet_100, Domain=subtraction, Wrap=True)  # -> List, Index
outer_bow_s_label = TextTag(Location=py_midpoint_labels.a, Text=subset.List, Colour=rgb_5)
py_outer_bow_s_labels = PythonScript(x=py_midpoint_labels.a, y=subset.List)  # -> out, a; inputs x: list of Point3d, y: list
# ---------- py_outer_bow_s_labels: Python ----------
# x = Location points
# y = Character labels

OuterBows = []
for i in range(len(x)):
    OuterBows.append((x[i],y[i]))

a = OuterBows
# ---------- end py_outer_bow_s_labels ----------

py_draw_force_vectors = PythonScript(
    x=py_saving_force_info.a,
    y=X_2,
    z=force_vector_length,
    u=pt,
    v=force_vector_length,
    w=create_force_sliders,
    t=perimeter_polyline)  # -> out, a, b, c, d, e; inputs x: list, y: Vector3d, u: list of Point3d, v: Int32, s: list, t: Curve
# ---------- py_draw_force_vectors: Python ----------
import Grasshopper as gh
import System.Drawing as sd

comp = ghenv.Component
ghdoc = comp.OnPingDocument()
canvas = gh.Instances.ActiveCanvas

Forces = x          # Forces [index, mag, angle]
RefPts = u             # Referenced Points
Surface = t

# ----- Create Sliders for Each Specified Force

if w == True:
    for i in range(0,len(Forces)):
        # Creates Slider with Attributes
        Slider = gh.Kernel.Special.GH_NumberSlider()
        Mag = Forces[i][1]
        # Adds Slider to Document
        ghdoc.AddObject(Slider,False,ghdoc.ObjectCount+1)
        # Select Input
        targetInput = comp.Params.Input[6]
        thisPivot = targetInput.Attributes.Pivot
        # Slider Location
        Slider.Attributes.Pivot = sd.PointF(thisPivot.X-1000,thisPivot.Y+(25*(i+1)))
        # Connects slider
        targetInput.AddSource(Slider)
        Slider.Slider.Maximum = 10
        Slider.SetSliderValue(Mag/1000)

Sliders = s
SlidMag = []

for i in Sliders:
    SlidMag.append(i*1000)

# ---- Draw vectors in Rhino Document

import rhinoscriptsyntax as rs
import scriptcontext as sc
import Rhino

UnitXVec = y
Scale = z

ForceNodes = []
ForceVectors = []
DispVectors = []
ForceVectorAnchors = []
for i in range(len(Forces)):
    degree = Forces[i][2]
    magnitude = Forces[i][1]
    forcevector = UnitXVec
    forcevector = rs.VectorScale(forcevector,Scale)
    forcevector = rs.VectorRotate(forcevector,-degree,(0,1,0))
    vectortrans = rs.VectorReverse(forcevector)
    pforce = RefPts[Forces[i][0]]
    fanchor = rs.PointAdd(pforce,vectortrans)
    if rs.PointInPlanarClosedCurve(fanchor, Surface) > 0:
        fanchor = rs.PointAdd(pforce,forcevector)
    ForceVectors.append(forcevector)
    if magnitude is not 0:
        ForceVectorAnchors.append(fanchor)
        DispVectors.append(forcevector)
    ForceNodes.append(pforce)

a = ForceVectorAnchors
b = ForceVectors
c = SlidMag
d = ForceNodes
e = DispVectors
# ---------- end py_draw_force_vectors ----------
support_vector_display_2 = VectorDisplayEx(Point=py_draw_force_vectors.a, Vector=py_draw_force_vectors.e, Colour=rgb_4, Width=force_vector_width)
a_force_vector_anchors = Panel(py_draw_force_vectors.a)
b_force_vectors = Panel(py_draw_force_vectors.b)
c_force_magnitudes = Panel(py_draw_force_vectors.c)

reverse_of_vector_2 = Reverse(Vector=py_draw_force_vectors.b)
line_2 = LineSDL(Start=py_draw_force_vectors.d, Direction=reverse_of_vector_2, Length=force_loa_length)

# ----
# FORCE & SUPPORT LABELS  {a l g o r i t h m}
# Sorting the segments in the same order as the midpoints of each segment
# Potential problem by choosing closest shattered perimeter segments based on their midpoints resulting in errors in naming
sorted_offset_segments = SortList(Keys=py_midpoint_labels.b, ValuesSegments=offset_perim_shattered_segments)  # -> Keys, ValuesSegments
py_label_forces_supports = PythonScript(
    x=sorted_offset_segments.ValuesSegments,
    y=subset.List,
    z=line,
    u=line_2,
    v=py_specify_supports,
    w=py_saving_force_info.a,
    s=pt_truss_nodes)  # -> out, a, b; inputs x: list of Curve, y: list, z: list of Curve, u: list of Curve, v: list, w: list, s: list
# ---------- py_label_forces_supports: Python ----------
import rhinoscriptsyntax as rs

OrderedSegments = x
SegmentLabels = y

SupportLOA = z
ForceLOA = u

Supports = v    # Type, Ind, Dir
Forces = w      # Ind, Mag, Dir

RefPts = s
ActiveIndices = []

Supports2 = []
for s in range(len(Supports)):
    Type = Supports[s][0]
    Ind = Supports[s][1]
    Dir = Supports[s][2]
    LOA = SupportLOA[s]
    Mdpt = rs.CurveMidPoint(LOA)
    Near = []
    for os in range(len(OrderedSegments)):
        Seg = OrderedSegments[os]
        SegMdpt = rs.CurveMidPoint(Seg)
        Dist = rs.Distance(Mdpt,SegMdpt)
        Near.append((Dist,os))
    Near.sort()
    Seg1ind = Near[0][1]
    Seg2ind = Near[1][1]
    Char1 = SegmentLabels[Seg1ind]
    Char2 = SegmentLabels[Seg2ind]
    if ord(Char2) == ord(Char1)+1:                  # if consecutive letters
        Supports2.append((Type,Ind,Dir,Char1,Char2))
    else:
        Supports2.append((Type,Ind,Dir,Char2,Char1))
    ActiveIndices.append(Ind)

b = Supports2

Forces2 = []
for f in range(len(Forces)):
    Ind = Forces[f][0]
    Mag = Forces[f][1]
    Dir = Forces[f][2]
    LOA = ForceLOA[f]
    Mdpt = rs.CurveMidPoint(LOA)
    Near = []
    for os in range(len(OrderedSegments)):
        Seg = OrderedSegments[os]
        SegStPt = rs.CurveStartPoint(Seg)
        Dist1 = rs.Distance(Mdpt,SegStPt)
        SegEndPt = rs.CurveEndPoint(Seg)
        Dist2 = rs.Distance(Mdpt,SegEndPt)
        if Dist1 < Dist2:
            Dist = Dist1
        else:
            Dist = Dist2
#        SegMdpt = rs.CurveMidPoint(Seg)
#        Dist = rs.Distance(Mdpt,SegMdpt)
        Near.append((Dist,os))
    Near.sort()
    Seg1ind = Near[0][1]
    Seg2ind = Near[1][1]
    Char1 = SegmentLabels[Seg1ind]
    Char2 = SegmentLabels[Seg2ind]
    if ord(Char2) == ord(Char1)+1:                  # if consecutive letters
        Forces2.append((Ind,Mag,Dir,Char1,Char2))
    else:
        Forces2.append((Ind,Mag,Dir,Char2,Char1))
    ActiveIndices.append(Ind)



a = Forces2
# ---------- end py_label_forces_supports ----------
a_forces_ind_mag_dir_char1_char2 = Panel(py_label_forces_supports.a)
b_supports_type_ind_dir_char1_char2 = Panel(py_label_forces_supports.b)

# ----
# SORTING FORCES {a l g o r i t h m}
sort_pt = SortPoints(Points=py_draw_force_vectors.d)  # -> Points, Indices
sort_pt_2 = SortPoints(Points=py_draw_support_vectors.c)  # -> Points, Indices
py_sort_forces_radially = PythonScript(x=py_draw_force_vectors.d, y=centroid.Centroid, z=sort_pt.Points, u=sort_pt_2.Points, v=py_draw_support_vectors.c)  # -> out, a, b; inputs x: list of Point3d, y: Point3d, z: list of Point3d, u: list of Point3d, v: list of Point3d
# ---------- py_sort_forces_radially: Python ----------
import rhinoscriptsyntax as rs
import Rhino.Geometry as rg 
import math

Centroid = y
ZXPlane = rs.WorldZXPlane()

# --- Sorting the force nodes radially
ForceNodes = x
SortedForceNodes = z
FormAnchorPt = SortedForceNodes[0]
AnchorVector = rs.VectorCreate(Centroid,FormAnchorPt)

RadialDistance = []
for i in range(len(ForceNodes)):
    N = ForceNodes[i]
    V = rs.VectorCreate(Centroid,N)
    d = rg.Vector3d.VectorAngle(AnchorVector,V,ZXPlane)
    D = round(math.degrees(d),1)
    if D == 360:
        d = 0
    RadialDistance.append(d)

a = RadialDistance  # of Forces

# --- Sorting Support Nodes Radially
SortedSupportNodes = u
SupportNodes = v
FormAnchorPt2 = SortedSupportNodes[0]
AnchorVector2 = rs.VectorCreate(Centroid,FormAnchorPt2)

RadialDistance2 = []
for i in range(len(SupportNodes)):
    N = SupportNodes[i]
    V = rs.VectorCreate(Centroid,N)
    d = rg.Vector3d.VectorAngle(AnchorVector2,V,ZXPlane)
    D = round(math.degrees(d),1)
    if D == 360:
        d = 0
    RadialDistance2.append(d)

b = RadialDistance2  # of Forces
# ---------- end py_sort_forces_radially ----------
sort_supports_radially = SortList(
    Keys=py_sort_forces_radially.b,
    ValuesSupportsList=py_label_forces_supports.b,
    ValuesSupportVectors=py_draw_support_vectors.b)  # -> Keys, ValuesSupportsList, ValuesSupportVectors, ValuesC, ValuesD
sort_forces_radially = SortList(Keys=py_sort_forces_radially.a, ValuesForcesList=py_label_forces_supports.a, ValuesForceVectors=py_draw_force_vectors.b)  # -> Keys, ValuesForcesList, ValuesForceVectors, ValuesC, ValuesD

# ----
# MEMBER LABELS  {a l g o r i t h m}
pattern_of_sortedtriangle_centroids = SortPoints(Points=py_detect_triangles.a)  # -> Points, Indices
sorted_triangles_via_centroids_pattern = ListItem(List=py_detect_triangles.c, Index=pattern_of_sortedtriangle_centroids.Indices, Wrap=True)
sorted_triangles_via_nurbs_crv_closest_p = SortList(Keys=crv_cp.Parameter, ValuesA=sorted_triangles_via_centroids_pattern)  # -> Keys, ValuesA; "Sorted Triangles via. Nurbs Crv Closest Pt"
panel = Panel("Ordered 1, 2, 3...")
py_labelling_members = PythonScript(
    x=sorted_triangles_via_nurbs_crv_closest_p.ValuesA,
    y=ln,
    z=subset.List,
    u=perimeter_polyline,
    v=py_midpoint_labels.c,
    w=py_midpoint_labels.d,
    s=sorted_offset_segments.ValuesSegments)  # -> out, a; inputs x: list of Curve, y: list of Curve, z: list, u: Curve, v: Point3d, w: Point3d, s: list of Curve
# ---------- py_labelling_members: Python ----------
import rhinoscriptsyntax as rs 
import Rhino.Geometry as rg

RefLn = y

# --- INNER MEMBERS via Overlap with Triangles
Triangles = x
Members = []
for i in range(len(RefLn)):
    Index = i
    Line = RefLn[i]
    Mdpt = rs.CurveMidPoint(Line)
    Char = []
    for t in range(len(Triangles)):
        Num = t
        Tri = Triangles[t]
        CCI = rs.CurveCurveIntersection(Line,Tri)
        if CCI is not None and CCI[0][0] == 2:
            Char.append(Num+1)
    if len(Char) == 1:
        Members.append((Index,Mdpt,Char[0]))
    if len(Char) == 2:
        Members.append((Index,Mdpt,Char[0],Char[1]))


# --- OUTER MEMBERS via overlap with perimeter, midpoint to centroid angle comparison

Alpha = z           # Truncated to appropriate open polygons
Perim = u           # Perimeter outline, single polyline
Centroid = v        # Centroid of enclosed surface of form
OffsetCorner = w    # Leftmost, bottommost point
OffsetSegments = s  # Should be ordered according to how it's labeled
#ParentVector = rs.VectorCreate(Centroid,FormAnchorPt)

# BUILDING SORTED SEGMENTS & CHARACTER NESTED LIST
SortedSegments = []
for s in range(len(OffsetSegments)):
    SortedSegments.append((OffsetSegments[s],Alpha[s]))

# BUILDING OUTER MEMBERS LIST via overlap with perimeter
OuterMembers = []
for j in range(len(RefLn)):
    Index = j
    Line = RefLn[j]
    CCI = rs.CurveCurveIntersection(Line,Perim)
    if CCI is not None and CCI[0][0] == 2:
        OuterMembers.append(Index)

# ADDING LETTER CHARACTERS TO MEMBERS LIST via proximity & parallelity to offset seg
for k in range(len(OuterMembers)):
    Index = OuterMembers[k]
    M_Line = RefLn[Index]
    M_Char1 = Members[Index][2]
    M_Mdpt = rs.CurveMidPoint(M_Line)
    M_sp = rs.CurveStartPoint(M_Line)
    M_ep = rs.CurveEndPoint(M_Line)
    M_Vec = rs.VectorCreate(M_sp,M_ep)
    CompareSeg = []
    for s in range(len(SortedSegments)):
        Segment = SortedSegments[s][0]
        SegChar = SortedSegments[s][1]
        S_Mdpt = rs.CurveMidPoint(Segment)
        S_sp = rs.CurveStartPoint(Segment)
        S_ep = rs.CurveEndPoint(Segment)
        S_Vec = rs.VectorCreate(S_sp,S_ep)
        Dist = rs.Distance(M_Mdpt,S_Mdpt)
        CompareSeg.append((Dist,S_Vec,SegChar))
    CompareSeg.sort()
    stop = 0
    cs = 0
    while stop < 1:
        CompareVec = CompareSeg[cs][1]
        NewChar = CompareSeg[cs][2]
        if rs.IsVectorParallelTo(CompareVec,M_Vec) is not 0:
            Members[Index] = (Index,M_Mdpt,M_Char1,NewChar)
            stop = 10
        else:
            cs = cs+1


a = Members

#OuterMembers = []
#XZPlane = rs.WorldZXPlane()
#for j in range(len(RefLn)):
#    endpoints = []
#    Index = j
#    Line = RefLn[j]
#    Mdpt = rs.CurveMidPoint(Line)
#    sp = rs.CurveStartPoint(Line)
#    ep = rs.CurveEndPoint(Line)
#    spdist = rs.Distance(sp,Centroid)
#    epdist = rs.Distance(ep,Centroid)
#    endpoints.append((spdist,sp))
#    endpoints.append((epdist,ep))
#    endpoints.sort()
#    pt = endpoints[1][1]
#    CCI = rs.CurveCurveIntersection(Line,Perim)
#    if CCI is not None and CCI[0][0] == 2:
#        Vec = rs.VectorCreate(Centroid,Mdpt)
#        Angle = rg.Vector3d.VectorAngle(ParentVector,Vec,XZPlane)
#        OuterMembers.append(j)
#        OuterMembers.append((Angle,j))

# --- Attaching characters to segments
#SortedSegments = s
#SegChar = []
#for a in range(len(Alpha)):
#    SegChar.append((SortedSegments[a],Alpha[a]))

#for OM in OuterMembers:
#    M = Members[OM]
#    I = M[0]
#    Line = RefLn[I]
#    MDPT = M[1]
#    CHAR = M[2]
#    Midpoint = rs.CurveMidPoint(Line)
#    sp = rs.CurveStartPoint(Line)
#    ep = rs.CurveEndPoint(Line)
#    OMVec = rs.VectorCreate(sp,ep)
#    CompareSeg = []
#    for s in range(len(SegChar)):
#        Seg = SegChar[s][0]
#        sChar = SegChar[s][1]
#        SegMdpt = rs.CurveMidPoint(Seg)
#        Dist = rs.Distance(Midpoint,SegMdpt)
#        sp2 = rs.CurveStartPoint(Seg)
#        ep2 = rs.CurveEndPoint(Seg)
#        SegVec = rs.VectorCreate(sp2,ep2)
#        CompareSeg.append((Dist,SegVec,sChar))
#    CompareSeg.sort()
#    for cs in range(len(CompareSeg)):
#        SegVec = CompareSeg[cs][1]
#        SEGChar = CompareSeg[cs][2]
#        if rs.IsVectorParallelTo(OMVec,SegVec) is not 0:
#            Members[OM] = (I,MDPT,CHAR,SEGChar)


#OuterMembers.sort() # Sorted by angle from endpoint to cenroid
#for om in range(len(OuterMembers)):
#    Index = OuterMembers[om][1]
#    M = Members[Index]
#    I = M[0]
#    MDPT = M[1]
#    CHAR = M[2]
#    if om > len(Alpha)-1:
#        charnew = Alpha[len(Alpha)-1]
#    else:
#        charnew = Alpha[om]
#    Members[Index] = (I,MDPT,CHAR,charnew)
# ---------- end py_labelling_members ----------
a_members_index_mdpt_char1_char2 = Panel(py_labelling_members.a)

# ----
# 8. CALCULATIONS
# 8.1 Click to calculate the 'member sense' for compression/tension calculations
# 8.2 Click to label the truss (in Rhino) with axial forces due to the following loads:
member_sense_calc = Button()
label_diagram_lateral_loads_only = Button()
label_diagram_gravity_loads_only = Button()
label_diagram_combined_loads = Button()
label_size = Slider(1.6, range=0..10)

# ----
# 6. {a l g o r i t h m}
vec = VectorXYZ(XComponent=ll_label_x, YComponent=0, ZComponent=ll_label_z)  # -> Vector, Length
panel_2 = Panel("""Lateral Load Line
Gravity Load Line
Combined Load Line""")
py_load_line_combined = PythonScript(
    x=pt_truss_nodes,
    y=sort_forces_radially.ValuesForcesList,
    z=sort_supports_radially.ValuesSupportsList,
    u=load_line_scale,
    v=load_line_start_pt_lateral,
    w=subset.List,
    s=sort_forces_radially.ValuesForceVectors,
    t=py_draw_support_vectors.b,
    xx=gravity_load_line_position,
    xy=combined_load_line_position,
    xz=horizontal_taken_by_left_support)  # -> out, a, b, c, d, e, f, g; inputs x: list of Point3d, y: list, z: list, v: Point3d, w: list, s: list of Vector3d, t: list of Vector3d
# ---------- py_load_line_combined: Python ----------
import rhinoscriptsyntax as rs
import random
import math

RefPts = x      # Referenced Points
Forces = y      # Index, Mag, Dir, #, #     {SORTED RADIALLY}
Supports = z    # Type, Ind, Dir, #, #      {SORTED RADIALLY}

LL_Scale = u    # Scale for load line
LL_Start = v    # Starting point for load line
Alphabet = w    # Exact letters used in labelling

ForceVectors = s    # 
SupportVectors = t  #

S1_C1 = Supports[0][3]  # Support 1, Character 1 {leftmost}
S1_C2 = Supports[0][4]

S2_C1 = Supports[1][3]  # Support 2, Character 2 {rightmost}
S2_C2 = Supports[1][4]

######## WIND ########
######################

R2_WIND = (0,0,0)       # zeroing out the effects of leftover calculations

# --- Drawing Initial Load Line for Wind
wp1 = LL_Start          # Starting point of wind load line
windLL_Nodes = [] 
windLL_Nodes.append(wp1)  
windLL_Char = []   
WindForces = []    
WindVectors = []
for i in range(len(Forces)):
    F = Forces[i]
    Deg = F[2]
    if Deg != 90 and Deg != 270:     # Isolating lateral loads
        Dir = math.radians(Deg)
        Mag = F[1]
        if Mag is not 0:                    # Isolating Zero Forces
            m = Mag/LL_Scale
            fchar1 = F[3]
            fchar2 = F[4]
            deltaX = m*math.cos(Dir)        # Creating scaled force vector
            deltaZ = m*math.sin(Dir)
            wp2 = rs.Str2Pt((wp1[0]+deltaX,wp1[1],wp1[2]+deltaZ))
            windLL_Nodes.append(wp2)
            if fchar1 not in windLL_Char:
                windLL_Char.append(fchar1)
            if fchar2 not in windLL_Char:
                windLL_Char.append(fchar2)
            wp1 = wp2
            WindForces.append(F)
            WindVectors.append(ForceVectors[i])

if len(windLL_Nodes) > 1:

    # --- Compiling Nodes and Letters into a Nested List
    windLoadLinePts = []    # Inventory (point, character); feed to Force Polygon
    for windLL in range(len(windLL_Nodes)):
        windLoadLinePts.append((windLL_Nodes[windLL],windLL_Char[windLL]))
    
    # --- Arbitrary Pole & Obtaining Slopes
    Rand = random.uniform(5,20)
    pole0 = rs.Str2Pt((LL_Start.X-Rand,LL_Start.Y,LL_Start.Z-Rand))
    
    WSlopes = []
    for ws in range(len(windLoadLinePts)):
        Point = windLoadLinePts[ws][0]
        deltaZ = pole0.Z-Point.Z
        deltaX = pole0.X-Point.X
        WSlopes.append(deltaZ/deltaX)
    
    # --- Drawing Funicular Shape
    
    WFirstNode = windLL_Nodes[0]
    WLastNode = windLL_Nodes[len(windLL_Nodes)-1]
    WR_dz = WFirstNode.Z-WLastNode.Z
    WR_dx = WFirstNode.X-WLastNode.X
    WR_Slope = WR_dz/WR_dx  # Slope of the resultant from wind forces
    
    WFStart = RefPts[Supports[0][1]]    # Support 1 is starting point of funicular polygon
    WFEnd = RefPts[Supports[1][1]]      # Support 2 is the end point of funicular polygon
    
    WFunicularPts = []
    WFunicularPts.append(WFStart)
    for wf in range(len(WSlopes)):
        if wf is 0: # FIRST POINT
            p1a = WFStart
            dx = 1
            dz = WSlopes[wf]*dx
            p2a = rs.Str2Pt((p1a.X+dx,p1a.Y,p1a.Z+dz))
            line1 = rs.AddLine(p1a,p2a)           
            # Line1 is parallel to slopes from arbitrary pole
            p1b = RefPts[WindForces[wf][0]]        # Node of applied wind force
            Vec = WindVectors[wf]
            matrix = rs.XformTranslation(Vec)
            p2b = rs.PointTransform(p1b,matrix)
            line2 = rs.AddLine(p1b,p2b)
            # Line 2 is parallel to the wind force vector
            Intersection = rs.LineLineIntersection(line1,line2)[0]  # (_,_,_)
            WFunicularPts.append(Intersection)
            p1a = Intersection
        elif wf is len(WSlopes)-1:  # LAST POINT
            dx = 1
            dz = WSlopes[wf]*dx
            p2a = rs.Str2Pt((p1a.X+dx,p1a.Y,p1a.Z+dz))
            line1 = rs.AddLine(p1a,p2a) 
            p1b = WFEnd
            dx = 1
            dz = WR_Slope*dx
            p2b = rs.Str2Pt((p1b.X+dx,p1b.Y,p1b.Z+dz))  # Assuming support LOA is parallel to resultant of wind loads
            line2 = rs.AddLine(p1b,p2b)
            Intersection = rs.LineLineIntersection(line1,line2)[0]
            WFunicularPts.append(Intersection)
        else:
            dx = 1
            dz = WSlopes[wf]*dx
            p2a = rs.Str2Pt((p1a.X+dx,p1a.Y,p1a.Z+dz))
            line1 = rs.AddLine(p1a,p2a)           
            # Line1 is parallel to slopes from arbitrary pole
            p1b = RefPts[WindForces[wf][0]]        # Node of applied wind force
            Vec = WindVectors[wf]
            matrix = rs.XformTranslation(Vec)
            p2b = rs.PointTransform(p1b,matrix)
            line2 = rs.AddLine(p1b,p2b)
            # Line 2 is parallel to the wind force vector
            Intersection = rs.LineLineIntersection(line1,line2)[0]  # (_,_,_)
            WFunicularPts.append(Intersection)
            p1a = Intersection
        rs.DeleteObject(line1)
        rs.DeleteObject(line2)
    
    # --- Using Closing Line to Find Reactions
    
    W_CL1 = WFunicularPts[0]
    W_CL2 = WFunicularPts[len(WFunicularPts)-1]
    W_CLslope = (W_CL1.Z-W_CL2.Z)/(W_CL1.X-W_CL2.X) # Closing line slope
    
    pole0 = pole0
    DX = 1
    DZ = W_CLslope*DX
    pole2 = rs.Str2Pt((pole0.X+DX,pole0.Y,pole0.Z+DZ))
    WTransCL = rs.AddLine(pole0,pole2)  # Drawing line paralle to closing line thru pole
    WindResultant = rs.AddLine(WFirstNode,WLastNode)    # Line of resultant of wind forces
    W_Intersection = rs.LineLineIntersection(WTransCL,WindResultant)[0]
    rs.DeleteObject(WindResultant)
    rs.DeleteObject(WTransCL)
    
    SupportType1 = Supports[0][0]
    SupportType2 = Supports[1][0]
    if SupportType1 == "Roller":
        LLsupP1 = windLL_Nodes[0]
        LLsupP2 = rs.Str2Pt((LLsupP1.X,LLsupP1.Y,LLsupP1.Z+1))
        RollerLine = rs.AddLine(LLsupP1,LLsupP2)
        HorizP1 = W_Intersection
        HorizP2 = rs.Str2Pt((HorizP1.X+1,HorizP1.Y,HorizP1.Z))
        HorizLine = rs.AddLine(HorizP1,HorizP2)
        W_FinalIntersection = rs.LineLineIntersection(RollerLine,HorizLine)[0]
        rs.DeleteObject(RollerLine)
        rs.DeleteObject(HorizLine)
    elif SupportType2 == "Roller":
        LLsupP1 = windLL_Nodes[len(windLL_Nodes)-1]
        LLsupP2 = rs.Str2Pt((LLsupP1.X,LLsupP1.Y,LLsupP1.Z+1))
        RollerLine = rs.AddLine(LLsupP1,LLsupP2)
        HorizP1 = W_Intersection
        HorizP2 = rs.Str2Pt((HorizP1.X+1,HorizP1.Y,HorizP1.Z))
        HorizLine = rs.AddLine(HorizP1,HorizP2)
        W_FinalIntersection = rs.LineLineIntersection(RollerLine,HorizLine)[0]
        rs.DeleteObject(RollerLine)
        rs.DeleteObject(HorizLine)
    else:
        LeftFrac = xz # Fraction of horizontal force taken by left support
        X1 = windLL_Nodes[0].X
        X2 = windLL_Nodes[len(windLL_Nodes)-1].X
        Z = W_Intersection.Z
        HorizP1 = rs.Str2Pt((X1,0,Z))
        HorizP2 = rs.Str2Pt((X2,0,Z))
        HorizLine = rs.AddLine(HorizP1,HorizP2)
        HorizLength = rs.CurveLength(HorizLine)
        DX = HorizLength*LeftFrac
        W_FinalIntersection = rs.Str2Pt((X1+DX,W_Intersection.Y,Z))
        rs.DeleteObject(HorizLine)
    #    Slider parameter that indicates percentage taken by leftmost pin support

    # --- Updating windLoadLinePts inventory of remaining characters
    
    # Adding consecutive letters from last load line point until support 2
    
    W_LastLLPt = windLoadLinePts[len(windLoadLinePts)-1][0]
    W_LastLLPtChar =  windLoadLinePts[len(windLoadLinePts)-1][1]
    Ord0 = ord(W_LastLLPtChar)
    Ord1 = ord(S2_C1)
    
    # REACTIONS FROM WIND
    
    R2_WIND = W_FinalIntersection - WLastNode         # Right support
    R1_WIND = WFirstNode - W_FinalIntersection      # Left support
    
    # Remaining top chord to rightmost support
    for ORDER in range(Ord0,Ord1+1):
        Letter = chr(ORDER)
        if Letter not in windLL_Char:
            windLoadLinePts.append((W_LastLLPt,Letter))
            windLL_Char.append(Letter)
            windLL_Nodes.append(W_LastLLPt)
    
    # Bottom chord to leftmost support
    ord0 = ord(Letter)
    ord1 = ord(S1_C1)
    for order in range(ord0,ord1+1):
        Letter = chr(order)
        if Letter not in windLL_Char:
            windLoadLinePts.append((W_FinalIntersection,Letter))
            windLL_Char.append(Letter)
            windLL_Nodes.append(W_FinalIntersection)

try:
    a = windLoadLinePts
    b = windLL_Nodes
except:
    pass

######## GRAVITY ########
#########################

GravLLPosition = xx

# obtaining initial starting point of gravity load line under wind force polygon
sortedWindLLNodes = rs.SortPoints(windLL_Nodes,True,4)  # Sort by Z coordinate
BottomMostNode = sortedWindLLNodes[0]
gp1 = rs.Str2Pt((LL_Start.X+GravLLPosition,LL_Start.Y,LL_Start.Z))
G_LLStart = gp1

# --- Top Chord Load Line for Gravity Loads
gravLL_Nodes = []
gravLL_Nodes.append(gp1)
gravLL_Char = []
GravForces = []
GravNodes = []
GravVectors = []
Support2Node = RefPts[Supports[1][1]]

stop = 0
j = 0
while stop < 100:
    F = Forces[j]
    Deg = F[2]
    ForceNode = RefPts[F[0]]
    if Deg == 90 or Deg == 270:   # Isolating gravity/vertical loads
        Dir = math.radians(Deg)
        Mag = F[1]
        if Mag is not 0:
            m = Mag/LL_Scale
            fchar1 = F[3]
            fchar2 = F[4]
            deltaX = m*math.cos(Dir)
            deltaZ = m*math.sin(Dir)
            gp2 = rs.Str2Pt((gp1[0]+deltaX,gp1[1],gp1[2]+deltaZ))
            gravLL_Nodes.append(gp2)
            if fchar1 not in gravLL_Char:
                gravLL_Char.append(fchar1)
            if fchar2 not in gravLL_Char:
                gravLL_Char.append(fchar2)
            gp1 = gp2
            GravForces.append(F)
            GravNodes.append(ForceNode)
            GravVectors.append(ForceVectors[j])
    j = j+1
    if ForceNode == Support2Node or j == len(Forces):
        stop = 100
        j = 0

if len(gravLL_Nodes) > 1:                   # IF NO TOP CHORD GRAV FORCES

    # --- Compiling Nodes and Letters into a Nested List (top chord)
    gravLoadLinePts = []
    for gravLL in range(len(gravLL_Nodes)):
        gravLoadLinePts.append((gravLL_Nodes[gravLL],gravLL_Char[gravLL]))
    
    # --- Arbitrary Pole & Obtaining Slopes (top chord)
    Rand = random.uniform(5,20)
    pole0 = rs.Str2Pt((G_LLStart.X-Rand,G_LLStart.Y,G_LLStart.Z-Rand))
    
    GSlopes = []
    for gs in range(len(gravLoadLinePts)):
        Point = gravLoadLinePts[gs][0]
        deltaZ = pole0.Z-Point.Z
        deltaX = pole0.X-Point.X
        GSlopes.append(deltaZ/deltaX)
    
    # --- Drawing Funicular Shape (top chord)
    
    GFStart = RefPts[Supports[0][1]]   # Support 1 as start of funicular polygon
    GFEnd = RefPts[Supports[1][1]]       # Support 2 as end of funicular polygon
    
    GFunicularPts = []
    GFunicularPts.append(GFStart)
    for gf in range(len(GSlopes)-1):
        if gf is 0:
            p1 = GFStart
            dx = GravNodes[gf].X-p1.X
            dz = dx*GSlopes[gf]
            p2 = rs.Str2Pt((p1.X+dx,p1.Y,p1.Z+dz))
            GFunicularPts.append(p2)
            p1 = p2
        elif gf is len(GSlopes)-1:
            dx = GFEnd.X-p1.X
            dz = dx*GSlopes[gf]
            p2 = rs.Str2Pt((p1.X+dx,p1.Y,p1.Z+dz))
            GFunicularPts.append(p2)
        else:
            dx = GravNodes[gf].X-p1.X
            dz = dx*GSlopes[gf]
            p2 = rs.Str2Pt((p1.X+dx,p1.Y,p1.Z+dz))
            GFunicularPts.append(p2)
            p1 = p2
    
    # --- Finding Reaction due to Top Chord, R1
    
    CLp1 = GFunicularPts[0]
    CLp2 = GFunicularPts[len(GFunicularPts)-1]
    CLSlope = (CLp1.Z-CLp2.Z)/(CLp1.X-CLp2.X)
    
    POLEp1 = pole0
    dx = 1
    dz = CLSlope*dx
    POLEp2 = rs.Str2Pt((POLEp1.X+dx,POLEp1.Y,POLEp1.Z+dz))
    ClosingLine1 = rs.AddLine(POLEp1,POLEp2)
    
    LLp1 = gravLL_Nodes[0]
    LLp2 = gravLL_Nodes[len(gravLL_Nodes)-1]
    GResultant1 = rs.AddLine(LLp1,LLp2)
    
    Rtop = rs.LineLineIntersection(ClosingLine1,GResultant1)[0]   # Reactions Top Chord
    R1_top = LLp1-Rtop  # Vector of leftmost support reaction from top chord gravity loads
    R2_top = Rtop - LLp2    # Vector of rightmost support reaction from top chord gravity loads
    
    rs.DeleteObject(ClosingLine1)
    rs.DeleteObject(GResultant1)

# --- Bottom Chord Load Line for Gravity Loads

gp1 = rs.Str2Pt((G_LLStart.X-2*LL_Scale,G_LLStart.Y,G_LLStart.Z))
G_LLStart2 = gp1

gravLL_Nodes2 = []
gravLL_Nodes2.append(gp1)
gravLL_Char2 = []
GravForces2 = []
GravNodes2 = []
GravVectors2 = []
Support1Node = RefPts[Supports[0][1]]

k = j   # Start index of the bottom chord from previous iteration
stop = 0
while stop < 100:
    F = Forces[k]
    Deg = F[2]
    ForceNode = RefPts[F[0]]
    if ForceNode == Support1Node:
        stop = 100
    else:
        if Deg == 90 or Deg == 270:   # Isolating gravity/vertical loads
            Dir = math.radians(Deg)
            Mag = F[1]
            if Mag is not 0:
                m = Mag/LL_Scale
                fchar1 = F[3]
                fchar2 = F[4]
                deltaX = m*math.cos(Dir)
                deltaZ = m*math.sin(Dir)
                gp2 = rs.Str2Pt((gp1[0]+deltaX,gp1[1],gp1[2]+deltaZ))
                gravLL_Nodes2.append(gp2)
                if fchar1 not in gravLL_Char2:
                    gravLL_Char2.append(fchar1)
                if fchar2 not in gravLL_Char2:
                    gravLL_Char2.append(fchar2)
                gp1 = gp2
                GravForces2.append(F)
                GravNodes2.append(ForceNode)
                GravVectors2.append(ForceVectors[j])
        if k == len(Forces)-1:
            k = 0
        else:
            k = k + 1

if len(gravLL_Nodes2) > 1:                     # IF NO BOTTOM CHORD GRAV FORCES

    # --- Compiling Nodes and Letters into a Nested List (bottom chord)
    gravLoadLinePts2 = []
    for gravLL in range(len(gravLL_Nodes2)):
        gravLoadLinePts2.append((gravLL_Nodes2[gravLL],gravLL_Char2[gravLL]))
    
    # --- Arbitrary Pole & Obtaining Slopes (bottom chord)
    Rand = random.uniform(5,20)
    pole0 = rs.Str2Pt((G_LLStart2.X-Rand,G_LLStart2.Y,G_LLStart2.Z-Rand/1.5))
    
    GSlopes2 = []
    for gs in range(len(gravLoadLinePts2)):
        Point = gravLoadLinePts2[gs][0]
        deltaZ = pole0.Z-Point.Z
        deltaX = pole0.X-Point.X
        GSlopes2.append(deltaZ/deltaX)
    
    # --- Drawing Funicular Shape (bottom chord)
    
    GFStart = WFStart   # Support 1 as start of funicular polygon
    GFEnd = WFEnd       # Support 2 as end of funicular polygon
    
    GravNodes2.reverse()
    GFunicularPts2 = []
    GFunicularPts2.append(GFStart)
    for gf in range(len(GSlopes2)):
        if gf is 0:
            p1 = GFStart
            dx = GravNodes2[gf].X-p1.X
            dz = dx*GSlopes2[gf]
            p2 = rs.Str2Pt((p1.X+dx,p1.Y,p1.Z+dz))
            GFunicularPts2.append(p2)
            p1 = p2
        elif gf is len(GSlopes2)-1:
            dx = GFEnd.X-p1.X
            dz = dx*GSlopes2[gf]
            p2 = rs.Str2Pt((p1.X+dx,p1.Y,p1.Z+dz))
            GFunicularPts2.append(p2)
        else:
            dx = GravNodes2[gf].X-p1.X
            dz = dx*GSlopes2[gf]
            p2 = rs.Str2Pt((p1.X+dx,p1.Y,p1.Z+dz))
            GFunicularPts2.append(p2)
            p1 = p2
    
    # --- Finding Reaction due to Bottom Chord, Rbottom
    
    CLp1 = GFunicularPts2[0]
    CLp2 = GFunicularPts2[len(GFunicularPts2)-1]
    CLSlope = (CLp1.Z-CLp2.Z)/(CLp1.X-CLp2.X)
    
    POLEp1 = pole0
    dx = 1
    dz = CLSlope*dx
    POLEp2 = rs.Str2Pt((POLEp1.X+dx,POLEp1.Y,POLEp1.Z+dz))
    ClosingLine1 = rs.AddLine(POLEp1,POLEp2)
    
    LLp1 = gravLL_Nodes2[0]
    LLp2 = gravLL_Nodes2[len(gravLL_Nodes2)-1]
    GResultant1 = rs.AddLine(LLp1,LLp2)
    
    Rbottom = rs.LineLineIntersection(ClosingLine1,GResultant1)[0]   # Reactions Bottom Chord
    R1_bot = LLp1-Rbottom  # Vector of leftmost support reaction from bottom chord gravity loads
    R2_bot = Rbottom - LLp2    # Vector of rightmost support reaction from bottom chord gravity loads
    
    rs.DeleteObject(ClosingLine1)
    rs.DeleteObject(GResultant1)

# -- Adding R2_bot to R2_top to find starting point of bottom chord load line

try:
    Rtop = Rtop             # if no top chord forces
except:
    Rtop = rs.Str2Pt((0,0,0))
    R2_bot = gp1

try:
    R2_bot = R2_bot         # if no bottom chord forces
except:
    R2_bot = rs.Str2Pt((0,0,0))
    Rtop = gp1

R2_Final = rs.Str2Pt((Rtop + R2_bot))

if len(gravLL_Char2) > 1:
    
    for bc in range(len(gravLL_Nodes2)):    # Adding remainder of bottom chord
        if bc == 0:
            Point = R2_Final
            Letter = gravLL_Char2[bc]
            Force = GravForces2[bc]
            Vec = GravVectors2[bc]
            gravLL_Nodes.append(Point)
            gravLL_Char.append(Letter)
            GravForces.append(Force)
            GravVectors.append(Vec)
            gravLoadLinePts.append((Point,Letter))
        else:
            dz = gravLL_Nodes2[bc].Z-gravLL_Nodes2[bc-1].Z
            Point = rs.Str2Pt((Point.X,Point.Y,Point.Z+dz))
            Letter = gravLL_Char2[bc]
            try:
                Force = GravForces2[bc]
                Vec = GravVectors2[bc]
            except:
                pass
            gravLL_Nodes.append(Point)
            gravLL_Char.append(Letter)
            GravForces.append(Force)
            GravVectors.append(Vec)
            gravLoadLinePts.append((Point,Letter))

# --- Adding consecutive letters of zero forces
try:
    G_LastLLPt = gravLoadLinePts[len(gravLoadLinePts)-1][0]
    G_LastLLPtChar = gravLoadLinePts[len(gravLoadLinePts)-1][1]
    Ord0 = ord(G_LastLLPtChar)
    Ord1 = ord(S2_C1)

    for ORDER in range(Ord0,Ord1+1):        # Top Chord
        Letter = chr(ORDER)
        if Letter not in gravLL_Char:
            gravLoadLinePts.append((G_LastLLPt,Letter))
            gravLL_Char.append(Letter)
            gravLL_Nodes.append(G_LastLLPt)
    
    ord0 = ord(Letter)
    ord1 = ord(S1_C1)
    
    for order in range(ord0,ord1+1):        # Bottom Chord
        Letter = chr(order)
        if Letter not in gravLL_Char:
            gravLoadLinePts.append((R2_Final,Letter))
            gravLL_Char.append(Letter)
            gravLL_Nodes.append(R2_Final)
    
    c = gravLoadLinePts
    d = gravLL_Nodes
except:
    pass

######## COMBINED ########
##########################

# --- Obtaining Resultant of Forces at Each Node

ResultantForces = []
for rf in range(len(Forces)):       # Assuming those that share same node are consecutive
    Force1 = Forces[rf]
    Index1 = Force1[0]
    try:
        IndexPrev = Forces[rf-1][0]
    except:
        IndexPrev = len(RefPts)+1
    if Index1 != IndexPrev:           # Prevent adding a force twice
        Mag1 = Force1[1]
        Dir1 = math.radians(Force1[2])
        Deg1 = Force1[2]
        fchar1 = Force1[3]
        fchar2 = Force1[4]
        if rf == len(Forces)-1:
            rf = -1
        else:
            rf = rf
        NextForce = Forces[rf+1]
        IndexNext = NextForce[0]
        if Index1 == IndexNext:             # Forces share same node 
            MagNext = NextForce[1]
            DirNext = math.radians(NextForce[2])
            DegNext = NextForce[2]
            dx1 = Mag1*math.cos(Dir1)
            dz1 = Mag1*math.sin(Dir1)
            dxnext = MagNext*math.cos(DirNext)
            dznext = MagNext*math.sin(DirNext)
            dxTOT = dx1+dxnext
            dzTOT = dz1+dznext
            DirTOT = math.atan(dzTOT/dxTOT)
            DegTOT = math.degrees(DirTOT)
            AngBetween = abs(Deg1-DegNext)
            QuadAngle = (360-2*AngBetween)/2
            QuadAngle = math.radians(QuadAngle)
            MagTOT = math.sqrt((Mag1**2)+(MagNext**2)-(2*Mag1*MagNext*math.cos(QuadAngle)))
            ResultantForces.append((Index1,MagTOT,DegTOT,fchar1,fchar2))
        else:
            ResultantForces.append((Index1,Mag1,Deg1,fchar1,fchar2))

# --- Initial starting point of Combined Load Line

CombLLPoint = xy

cp1 = rs.Str2Pt((G_LLStart.X+CombLLPoint,G_LLStart.Y,G_LLStart.Z))
C_LLStart = cp1

# --- Drawing the Load Line for the Top Chord (Combined)
combinedLL_Nodes = []
combinedLL_Nodes.append(cp1)
combinedLL_Char = []
combinedForces = []
combinedNodes = []
Support2Node = RefPts[Supports[1][1]]

stop = 0
j = 0
while stop < 100:
    F = ResultantForces[j]
    ForceNode = RefPts[F[0]]
    Deg = F[2]
    Dir = math.radians(Deg)
    Mag = F[1]
    if Mag is not 0:
        m = Mag/LL_Scale
        fchar1 = F[3]
        fchar2 = F[4]
        deltaX = m*math.cos(Dir)
        deltaZ = m*math.sin(Dir)
        cp2 = rs.Str2Pt((cp1[0]+deltaX,cp1[1],cp1[2]+deltaZ))
        combinedLL_Nodes.append(cp2)
        if fchar1 not in combinedLL_Char:
            combinedLL_Char.append(fchar1)
        if fchar2 not in combinedLL_Char:
            combinedLL_Char.append(fchar2)
        cp1 = cp2
        combinedForces.append(F)
        combinedNodes.append(ForceNode)
    j = j+1
    if ForceNode == Support2Node or j == len(ResultantForces):
        stop = 100
        j = 0

BC = len(combinedLL_Char)   # Starting point of updating the combinedLoadLinePts inventory for the bottom chord

# --- Compiling Nodes and Letters into a Nested List (top chord)
combinedLoadLinePts = []
for cLL in range(len(combinedLL_Nodes)):
    combinedLoadLinePts.append((combinedLL_Nodes[cLL],combinedLL_Char[cLL]))

# --- Adding Resultant R2 to find new starting point of bottom chord load line

try:
    R2_top = R2_top     # right support vector due to top chord grav loads
except:
    R2_top = rs.VectorCreate((0,0,0),(0,0,0))


R2_GRAV = R2_top + R2_bot   # Resultant vector due to gravity
R2_WIND = R2_WIND           # Resultant vector due to wind

R2_TOTAL = rs.VectorAdd(R2_GRAV,R2_WIND)

comb_bottomchord_LLstartpt = (combinedLL_Nodes[len(combinedLL_Nodes)-1]+R2_TOTAL)

# --- Bottom Chord Load Line for Gravity Loads

k = j   # Start index of the bottom chord from previous iteration
stop = 0
cp1 = comb_bottomchord_LLstartpt
if len(gravLL_Nodes2) > 1:
    combinedNodes.append(cp1)
    combinedLL_Nodes.append(cp1)
while stop < 100:
    F = ResultantForces[k]
    Deg = F[2]
    ForceNode = RefPts[F[0]]
    if ForceNode == Support1Node:
        stop = 100
    else:
        Dir = math.radians(Deg)
        Mag = F[1]
        if Mag is not 0:
            m = Mag/LL_Scale
            fchar1 = F[3]
            fchar2 = F[4]
            deltaX = m*math.cos(Dir)
            deltaZ = m*math.sin(Dir)
            cp2 = rs.Str2Pt((cp1[0]+deltaX,cp1[1],cp1[2]+deltaZ))
            combinedLL_Nodes.append(cp2)
            if fchar1 not in combinedLL_Char:
                combinedLL_Char.append(fchar1)
            if fchar2 not in combinedLL_Char:
                combinedLL_Char.append(fchar2)
            cp1 = cp2
            combinedForces.append(F)
            combinedNodes.append(ForceNode)
    if k == len(ResultantForces)-1:
        k = 0
    else:
        k = k + 1

# --- Compiling Nodes and Letters into a Nested List (bottom chord)
for cLL in range(BC,len(combinedLL_Nodes)):
    combinedLoadLinePts.append((combinedLL_Nodes[cLL],combinedLL_Char[cLL]))

# --- Adding consecutive letters of zero forces
C_LastLLPt = combinedLoadLinePts[len(combinedLoadLinePts)-1][0]
C_LastLLPtChar = combinedLoadLinePts[len(combinedLoadLinePts)-1][1]
Ord0 = ord(C_LastLLPtChar)
Ord1 = ord(S2_C1)

for ORDER in range(Ord0,Ord1+1):        # Top Chord
    Letter = chr(ORDER)
    if Letter not in combinedLL_Char:
        combinedLoadLinePts.append((C_LastLLPt,Letter))
        combinedLL_Char.append(Letter)
        combinedLL_Nodes.append(C_LastLLPt)

ord0 = ord(Letter)
ord1 = ord(S1_C1)

for order in range(ord0,ord1+1):        # Bottom Chord
    Letter = chr(order)
    if Letter not in combinedLL_Char:
        combinedLoadLinePts.append((comb_bottomchord_LLstartpt,Letter))
        combinedLL_Char.append(Letter)
        combinedLL_Nodes.append(comb_bottomchord_LLstartpt)

e = combinedLoadLinePts
f = combinedLL_Nodes

LLStartPts = []
LLStartPts.append(LL_Start)
LLStartPts.append(G_LLStart)
LLStartPts.append(C_LLStart)

g = LLStartPts
# ---------- end py_load_line_combined ----------
move = Move(Geometry=py_load_line_combined.g, Motion=vec.Vector)  # -> Geometry, Transform
text_tag_load_line_titles = TextTag(Location=move.Geometry, Text=panel_2)
shifting_ll_points_wind = ShiftList(List=py_load_line_combined.b, Shift=1, Wrap=True)
shifting_ll_points_grav = ShiftList(List=py_load_line_combined.d, Shift=1, Wrap=True)
shifting_ll_points_grav_2 = ShiftList(List=py_load_line_combined.f, Shift=1, Wrap=True)
load_line_lines_wind = Line(StartPoint=py_load_line_combined.b, EndPoint=shifting_ll_points_wind)
load_line_lines_grav = Line(StartPoint=py_load_line_combined.d, EndPoint=shifting_ll_points_grav)
load_line_lines_grav_2 = Line(StartPoint=py_load_line_combined.f, EndPoint=shifting_ll_points_grav_2)
a_windloadlinepts_point = Panel(py_load_line_combined.a)
c_gravloadlinepts_point = Panel(py_load_line_combined.c)
e_combinedloadlinepts_point = Panel(py_load_line_combined.e)
panel_3 = Panel("""Load Path: 
Load Path: 
Load Path: """)
Z = UnitZ(Factor=1)
rev = Reverse(Vector=Z)
amp = Amplitude(Vector=rev, Amplitude=tlp_label_z)
move_2 = Move(Geometry=move.Geometry, Motion=amp)  # -> Geometry, Transform

# ----
# 7c {a l g o r i t h m} [Combined]
py_draw_force_polygon_new = PythonScript(x=update_force_polygon_combined, y=py_load_line_combined.e, z=py_labelling_members.a, u=ln, v=int_2)  # -> out, a, b, c, d, e, f, g; inputs y: list, z: list, u: list of Curve, v: list
# ---------- py_draw_force_polygon_new: Python ----------
import rhinoscriptsyntax as rs

Members = z         # Index, Mdpt, Char1, Char2
RefLines = u        # Referenced lines
InnerNumbers = v

# OBTAINING POINTS FOR FORCE POLYGON LINES
rs.AddGroup("Construction Lines")
if x == True:
    LoadLinePts = y     # Point, Char
    FP_Points = []
    FP_Char = []
    fp_char = []
    # Creating inventory of known points
    for LL in range(len(LoadLinePts)):
        LLPT = LoadLinePts[LL][1]
        FP_Char.append(LLPT)
    # For each number from inner polygon
    for i in range(len(InnerNumbers)):
        # Gathering members with number #
        Three = []
        Num = InnerNumbers[i]
        for j in range(len(Members)):
            Mchar1 = Members[j][2]
            Mchar2 = Members[j][3]
            if (Num == int(Mchar1)) or (Num == Mchar2):
                Three.append(Members[j])
        # If other character exists in FP_Char, obtain slope info
        Two = []
        for k in range(len(Three)):
            char1 = Three[k][2]
            char2 = Three[k][3]
            if char2 in FP_Char or char1 in FP_Char:
                Index = Three[k][0]
                Line1 = RefLines[Index]
                p1 = rs.CurveStartPoint(Line1)
                p2 = rs.CurveEndPoint(Line1)
                DX = p2.X-p1.X
                DZ = p2.Z-p1.Z
                for L in range(len(LoadLinePts)):
                    if char2 == LoadLinePts[L][1] or char1 == LoadLinePts[L][1]:
                        p3 = LoadLinePts[L][0]
                p4 = rs.AddPoint(p3.X+DX,p3.Y,p3.Z+DZ)
                L1 = rs.AddLine(p3,rs.PointCoordinates(p4))
                Two.append(L1)
                rs.AddObjectToGroup(L1,"Construction Lines")
                rs.DeleteObject(p4)
        Intersection = rs.LineLineIntersection(Two[0],Two[1])
        NewPoint = Intersection[0]
        FP_Points.append(NewPoint)
        FP_Char.append(Num)
        LoadLinePts.append((NewPoint,Num))
        DELETE = rs.ObjectsByGroup("Construction Lines")
        for d in DELETE:
            rs.DeleteObject(d)

# DRAWING FORCE POLYGON LINES
ForcePolygonPts = LoadLinePts
ForcePolygonLns = []
FP_PointPairs = []
FP_PointsLabels = []
for m in range(len(Members)):
    try:
        char1 = int(Members[m][2])
    except:
        char1 = Members[m][2]
    try:
        char2 = int(Members[m][3])
    except:
        char2 = Members[m][3]
    for C in range(len(ForcePolygonPts)):
        try:
            if char1 == int(ForcePolygonPts[C][1]):
                p1 = ForcePolygonPts[C][0]
        except:
            if char1 == ForcePolygonPts[C][1]:
                p1 = ForcePolygonPts[C][0]
        try:
            if char2 == int(ForcePolygonPts[C][1]):
                p2 = ForcePolygonPts[C][0]
        except:
            if char2 == ForcePolygonPts[C][1]:
                p2 = ForcePolygonPts[C][0]
    FP_PointPairs.append(p1)
    FP_PointPairs.append(p2)
    FP_PointsLabels.append((char1,char2))


a = FP_Points
b = InnerNumbers
c = ForcePolygonPts
d = FP_PointPairs
e = FP_PointsLabels
# ---------- end py_draw_force_polygon_new ----------
py_force_polygon_node_lables = PythonScript(x=py_draw_force_polygon_new.c)  # -> out, a, b; inputs x: list
# ---------- py_force_polygon_node_lables: Python ----------
import rhinoscriptsyntax as rs

# Finding letters that share a node and concating them into strings

ForcePolygonPts = x

fp_node = []
fp_char = []
for i in range(len(ForcePolygonPts)):
    P = ForcePolygonPts[i][0]   # point
    T = str(ForcePolygonPts[i][1])   # text
    Test = 0
    ind = []
    for j in range(len(fp_node)):
        Vec = P-fp_node[j]
        if rs.IsVectorTiny(Vec):
            Test = Test + 1
            ind.append(j)
        else:
            Test = Test + 0
    if Test == 0:
        fp_node.append(P)
        fp_char.append(T)
    else:
        for I in ind:
            try:
                fp_char[I]= (", ".join(fp_char[I]),T)
            except:
                fp_char[I]= (fp_char[I],T)

a = fp_node
b = fp_char
# ---------- end py_force_polygon_node_lables ----------
c_forcepolygonpts_point_num_char = Panel(py_draw_force_polygon_new.c)
partition = PartitionList(List=py_draw_force_polygon_new.d, Size=2)
X_3 = UnitX(Factor=1)
item = ListItem(List=partition, Index="0", Wrap=True)
item_2 = ListItem(List=partition, Index="1", Wrap=True)
division = Division(A=X_3, B=distance_of_ll_labels_combined)
force_polygon_number_lines = Line(StartPoint=item, EndPoint=item_2)
move_3 = Move(Geometry=py_force_polygon_node_lables.a, Motion=division)  # -> Geometry, Transform
fp_lines_flattened = FlattenTree(Tree=force_polygon_number_lines, Path="{0}")
force_polygon_number_nodes = TextTag(Location=move_3.Geometry, Text=py_force_polygon_node_lables.b)

# ----
# 7a {a l g o r i t h m} [Lateral]
py_draw_force_polygon_new_2 = PythonScript(x=update_force_polygon_lateral, y=py_load_line_combined.a, z=py_labelling_members.a, u=ln, v=int_2)  # -> out, a, b, c, d, e, f, g; inputs y: list, z: list, u: list of Curve, v: list; same code as py_draw_force_polygon_new
py_force_polygon_node_lables_2 = PythonScript(x=py_draw_force_polygon_new_2.c)  # -> out, a, b; inputs x: list; same code as py_force_polygon_node_lables
c_forcepolygonpts_point_num_char_2 = Panel(py_draw_force_polygon_new_2.c)
partition_2 = PartitionList(List=py_draw_force_polygon_new_2.d, Size=2)
X_4 = UnitX(Factor=1)
item_3 = ListItem(List=partition_2, Index="0", Wrap=True)
item_4 = ListItem(List=partition_2, Index="1", Wrap=True)
division_2 = Division(A=X_4, B=distance_of_ll_labels_lateral)
force_polygon_number_lines_2 = Line(StartPoint=item_3, EndPoint=item_4)
move_4 = Move(Geometry=py_force_polygon_node_lables_2.a, Motion=division_2)  # -> Geometry, Transform
fp_lines_flattened_2 = FlattenTree(Tree=force_polygon_number_lines_2, Path="{0}")
force_polygon_number_nodes_2 = TextTag(Location=move_4.Geometry, Text=py_force_polygon_node_lables_2.b)

# ----
# 7b {a l g o r i t h m} [Gravity]
py_draw_force_polygon_new_3 = PythonScript(x=update_force_polygon_gravity, y=py_load_line_combined.c, z=py_labelling_members.a, u=ln, v=int_2)  # -> out, a, b, c, d, e, f, g; inputs y: list, z: list, u: list of Curve, v: list; same code as py_draw_force_polygon_new
py_force_polygon_node_lables_3 = PythonScript(x=py_draw_force_polygon_new_3.c)  # -> out, a, b; inputs x: list; same code as py_force_polygon_node_lables
c_forcepolygonpts_point_num_char_3 = Panel(py_draw_force_polygon_new_3.c)
partition_3 = PartitionList(List=py_draw_force_polygon_new_3.d, Size=2)
X_5 = UnitX(Factor=1)
item_5 = ListItem(List=partition_3, Index="0", Wrap=True)
item_6 = ListItem(List=partition_3, Index="1", Wrap=True)
division_3 = Division(A=X_5, B=distance_of_ll_labels_gravity)
force_polygon_number_lines_3 = Line(StartPoint=item_5, EndPoint=item_6)
move_5 = Move(Geometry=py_force_polygon_node_lables_3.a, Motion=division_3)  # -> Geometry, Transform
fp_lines_flattened_3 = FlattenTree(Tree=force_polygon_number_lines_3, Path="{0}")
force_polygon_number_nodes_3 = TextTag(Location=move_5.Geometry, Text=py_force_polygon_node_lables_3.b)

# ----
# 8a {a l g o r i t h m} Calculate forces (Lateral)
py_member_sense = PythonScript(x=ln, y=py_labelling_members.a, z=py_inner_bows_points.a, u=py_outer_bow_s_labels.a, v=member_sense_calc)  # -> out, a; inputs x: list of Curve, y: list, z: list, u: list
# ---------- py_member_sense: Python ----------
import rhinoscriptsyntax as rs

RefLn = x
Members = y     # Index, Mdpt, Char1, Char2
InnerBows = z   # Point, Char
OuterBows = u   # Point, Char

# COMPILING LABEL POINTS & CHARCTERS
LabelPts = []
for ob in OuterBows:
    LabelPts.append(ob)
for ib in InnerBows:
    LabelPts.append(ib)

# COMPILING MEMBER SENSE
if v == True:
    MemberSense = []
    for m in range(len(Members)):
        Index = Members[m][0]
        Line = RefLn[Index]
        mchar1 = Members[m][2]
        mchar2 = Members[m][3]
        for lp in range(len(LabelPts)):
            if LabelPts[lp][1] == mchar1:
                p1 = LabelPts[lp][0]
            if LabelPts[lp][1] == mchar2:
                p2 = LabelPts[lp][0]
        LabelVec = rs.VectorCreate(p2,p1)
        m1 = rs.CurveStartPoint(Line)
        m2 = rs.CurveEndPoint(Line)
        MemberVec = rs.VectorCreate(m1,m2)
        STOP = 0
        while STOP < 1:
            PL = rs.IsVectorParallelTo(LabelVec,MemberVec)
            if PL is not 0:
                MemberSense.append((Index,mchar1,mchar2,LabelVec))
                STOP = 1
            else:
                LabelVec = rs.VectorRotate(LabelVec,.02,[0,1,0])

print PL

a = MemberSense # Index, Char1, Char2, LabelVec
# ---------- end py_member_sense ----------
py_calculate_forces = PythonScript(
    x=fp_lines_flattened_2,
    y=py_draw_force_polygon_new_2.e,
    z=load_line_scale,
    u=label_diagram_lateral_loads_only,
    v=py_labelling_members.a,
    w=py_draw_force_polygon_new_2.c,
    s=py_member_sense.a,
    t=ln,
    xx=label_size)  # -> out, a, b, c, d, e; inputs x: list of Curve, y: list, v: list, w: list, s: list, t: list of Curve
# ---------- py_calculate_forces: Python ----------
import rhinoscriptsyntax as rs

# Calculating Compression/Tension
MemberSense = s
ForcePolygonPts = w
CompressionTension = []
for m in range(len(MemberSense)):
    Index = MemberSense[m][0]
    char1 = MemberSense[m][1]
    char2 = MemberSense[m][2]
    sense = MemberSense[m][3]
    for fp in range(len(ForcePolygonPts)):
        FP = ForcePolygonPts[fp]
        if FP[1] == char1:
            p1 = FP[0]
        if FP[1] == char2:
            p2 = FP[0]
    FPVec = rs.VectorCreate(p2,p1)
    Result = -1*rs.IsVectorParallelTo(FPVec,sense)
    CompressionTension.append(Result)

# Calculating Member Forces
MemberForces = []
FP_Lines = x    # From force polygon drawing
FP_Labels = y   # From force polygon drawing
Scale = z       # Force per unit length
for i in range(len(FP_Lines)):
    Line = FP_Lines[i]
    Length = rs.CurveLength(Line)
    Force = Length*Scale
    Name = FP_Labels[i]
    Char1 = Name[0]
    Char2 = Name[1]
    MemberForces.append((Line,Force,Char1,Char2))

# Calculating Load Path
Members = v
RefLn = t
LoadPath = []
MembersFinal = []
ForceLabel = []
for m in range(len(Members)):
    Index = Members[m][0]
    Midpoint = Members[m][1]
    Line = RefLn[Index]
    try:
        Mchar1 = float(Members[m][2])
    except:
        Mchar1 = Members[m][2]
    try:
        Mchar2 = float(Members[m][3])
    except:
        Mchar2 = Members[m][3]
    for F in range(len(MemberForces)):
        try:
            mchar1 = float(MemberForces[F][2])
        except:
            mchar1 = MemberForces[F][2]
        try:
            mchar2 = float(MemberForces[F][3])
        except:
            mchar2 = MemberForces[F][3]
        mcharboth = [mchar1,mchar2]
        if Mchar1 in mcharboth and Mchar2 in mcharboth:
            Force = MemberForces[F][1]
            Force = Force*CompressionTension[m]
            if Force == 0:
                Force = "0"
                MembersFinal.append((Index, Midpoint, mchar1, mchar2, Force, MemberSense[m][3]))
            else:
                MembersFinal.append((Index, Midpoint, mchar1, mchar2, round(Force,3), MemberSense[m][3]))
            ForceLabel.append((Force,Midpoint))
            MemberLength = float(rs.CurveLength(Line))
            if MemberLength == 0 or Force == "0":
                FxL = int(0)
            else:
                FxL = MemberLength*Force
            LoadPath.append(round(FxL,3))
a = MembersFinal
b = LoadPath


# Separate Load Paths
TensionLP = []
CompressionLP = []
TotalLP = []
for value in LoadPath:
    if value is not 0:
        if value > 0:
            TensionLP.append(value)
        else:
            CompressionLP.append(value)
    TotalLP.append(abs(value))
c = CompressionLP
d = TensionLP
e = sum(TotalLP)

# Labeling the form diagram
rs.AddGroup("Force Labels")
LabelSize = xx
if u == True:
    for FL in range(len(ForceLabel)):
        Force = ForceLabel[FL][0]
        try:
            Force = round(Force,3)
        except:
            pass
        Mdpt = ForceLabel[FL][1]
        if Force < 0:
            style = 0
        else:
            style = 1
        Label = rs.AddText(str(Force),Mdpt,LabelSize,"Arial",style)
        rs.AddObjectToGroup(Label,"Force Labels")
# ---------- end py_calculate_forces ----------
c_compression_load_path_fc_x_lc = Panel(py_calculate_forces.c)
d_tension_load_path_ft_x_lt = Panel(py_calculate_forces.d)
a_membersfinal_index_midpoint_char1_char = Panel(py_calculate_forces.a)  # "A: MembersFinal (Index, Midpoint, Char1, Char2, Force, Sense)"
b_loadpath = Panel(py_calculate_forces.b)

# ----
# 8c {a l g o r i t h m} Calculate forces (Combined)
py_calculate_forces_2 = PythonScript(
    x=fp_lines_flattened,
    y=py_draw_force_polygon_new.e,
    z=load_line_scale,
    u=label_diagram_combined_loads,
    v=py_labelling_members.a,
    w=py_draw_force_polygon_new.c,
    s=py_member_sense.a,
    t=ln,
    xx=label_size)  # -> out, a, b, c, d, e; inputs x: list of Curve, y: list, v: list, w: list, s: list, t: list of Curve; same code as py_calculate_forces
d_tension_load_path_ft_x_lt_2 = Panel(py_calculate_forces_2.d)
c_compression_load_path_fc_x_lc_2 = Panel(py_calculate_forces_2.c)
a_membersfinal_index_midpoint_char1_char_2 = Panel(py_calculate_forces_2.a)  # "A: MembersFinal (Index, Midpoint, Char1, Char2, Force, Sense)"
b_loadpath_2 = Panel(py_calculate_forces_2.b)

# ----
# 8b {a l g o r i t h m} Calculate forces (Gravity)
py_calculate_forces_3 = PythonScript(
    x=fp_lines_flattened_3,
    y=py_draw_force_polygon_new_3.e,
    z=load_line_scale,
    u=label_diagram_gravity_loads_only,
    v=py_labelling_members.a,
    w=py_draw_force_polygon_new_3.c,
    s=py_member_sense.a,
    t=ln,
    xx=label_size)  # -> out, a, b, c, d, e; inputs x: list of Curve, y: list, v: list, w: list, s: list, t: list of Curve; same code as py_calculate_forces
c_compression_load_path_fc_x_lc_3 = Panel(py_calculate_forces_3.c)
d_tension_load_path_ft_x_lt_3 = Panel(py_calculate_forces_3.d)
a_membersfinal_index_midpoint_char1_char_3 = Panel(py_calculate_forces_3.a)  # "A: MembersFinal (Index, Midpoint, Char1, Char2, Force, Sense)"
b_loadpath_3 = Panel(py_calculate_forces_3.b)

e_total_load_path_combined_loads = Panel(py_calculate_forces_2.e)
e_total_load_path_gravity_loads = Panel(py_calculate_forces_3.e)
e_total_load_path_lateral_loads = Panel(py_calculate_forces.e)

py_total_load_paths = PythonScript(x=e_total_load_path_lateral_loads, y=e_total_load_path_gravity_loads, z=e_total_load_path_combined_loads)  # -> out, a
# ---------- py_total_load_paths: Python ----------
if x is None:
    LateralLP = 0
else:
    LateralLP = x

if y is None:
    GravityLP = 0
else:
    GravityLP = y

if z is None:
    CombinedLP = 0
else:
    CombinedLP = z

List = [LateralLP, GravityLP, CombinedLP]

a = List
# ---------- end py_total_load_paths ----------
panel_4 = Panel(py_total_load_paths.a)
concat = Concatenate(FragmentA=panel_3, FragmentB=panel_4)
panel_5 = Panel(concat)
tag = TextTag(Location=move_2.Geometry, Text=panel_5)
